# Grasshopper definition 01_LUSAS_GH_CoolingTower.gh (Grasshopper 1.0.8)
# plug-ins: LUSAS_Grasshopper

# ----
# Bottom Radius
# Top to Bottom
# Radius Ratio
# Height
# Number of Supports
# Support Height
number_slider = Slider(44, range=0..100)
number_slider_2 = Slider(150, range=0..1000)
number_slider_3 = Slider(12, range=0..100)

construct_point = ConstructPoint(XCoordinate=0, YCoordinate=0, ZCoordinate=0)
circle_cnr = CircleCNR(Center=construct_point, Normal=Vector(0, 0, 1), Radius=number_slider)
unit_z = UnitZ(Factor=number_slider_2)
construct_point_2 = ConstructPoint(XCoordinate=0, YCoordinate=0, ZCoordinate=number_slider_2)
move = Move(Geometry=circle_cnr, Motion=unit_z)  # -> Geometry, Transform
scale = Scale(Geometry=move.Geometry, Center=construct_point_2, Factor=Slider(0.7, range=0..1))  # -> Geometry, Transform
divide_curve = DivideCurve(Curve=circle_cnr, Count=number_slider_3, Kinks=False)  # -> Points, Tangents, Parameters
divide_curve_2 = DivideCurve(Curve=scale.Geometry, Count=number_slider_3, Kinks=False)  # -> Points, Tangents, Parameters
shift_list = ShiftList(List=divide_curve.Points, Shift="3", Wrap=True)
pi = Pi(Factor=1)
line = Line(StartPoint=divide_curve_2.Points, EndPoint=shift_list)
multiplication = Multiplication(A="2", B=pi)
multiplication_2 = Multiplication(A=number_slider_3, B="2")
division = Division(A=multiplication, B=multiplication_2)
loft_options = LoftOptions(Closed=True, Adjust=False, Rebuild=0, Refit=0, Type=0)
sort_along_curve = SortAlongCurve(Points=divide_curve.Points, Curve=circle_cnr)  # -> flatten(Points), Indices
construct_point_3 = ConstructPoint(XCoordinate=0, YCoordinate=0, ZCoordinate="1")
construct_point_4 = ConstructPoint(XCoordinate=0, YCoordinate=0, ZCoordinate=0)
loft = Loft(Curves=line, Options=loft_options)  # -> flatten(Loft)
plane_offset = PlaneOffset(BasePlane=PlaneXY(0, 0, 0), Offset=Slider(15, range=0..100))
brep_plane = BrepPlane(Brep=loft, Plane=plane_offset)  # -> Curves, Points
divide_curve_3 = DivideCurve(Curve=brep_plane.Curves, Count=number_slider_3, Kinks=False)  # -> Points, Tangents, Parameters
line_2 = Line(StartPoint=construct_point_4, EndPoint=construct_point_3)
surface_split = SurfaceSplit(Surface=loft, Curves=brep_plane.Curves)
rotate_axis = RotateAxis(Geometry=sort_along_curve.Points, Angle=division, Axis=line_2)  # -> Geometry, Transform
sort_along_curve_2 = SortAlongCurve(Points=divide_curve_3.Points, Curve=brep_plane.Curves)  # -> flatten(Points), Indices
list_item = ListItem(List=surface_split, Index=0, Wrap=True)
addition = Addition(A="3", B="1")
brep_edges = BrepEdges(Brep=list_item)  # -> Naked, Interior, NonManifold
shift_list_2 = ShiftList(List=sort_along_curve_2.Points, Shift=addition, Wrap=True)
shift_list_3 = ShiftList(List=sort_along_curve_2.Points, Shift="3", Wrap=True)
construct_point_5 = ConstructPoint(XCoordinate=0, YCoordinate=0, ZCoordinate="1")
construct_point_6 = ConstructPoint(XCoordinate=0, YCoordinate=0, ZCoordinate=0)
reverse_list = ReverseList(List=shift_list_3)
reverse_list_2 = ReverseList(List=shift_list_2)
line_3 = Line(StartPoint=construct_point_6, EndPoint=construct_point_5)
line_4 = Line(StartPoint=reverse_list, EndPoint=rotate_axis.Geometry)
line_5 = Line(StartPoint=reverse_list_2, EndPoint=rotate_axis.Geometry)
mirror_curve = MirrorCurve(Geometry=brep_edges.Interior, Curve=line_3, Tangent=True)
end_points = EndPoints(Curve=line_4)  # -> Start, End
surface_split_2 = SurfaceSplit(Surface=list_item, Curves=mirror_curve)
surface_split_3 = SurfaceSplit(Surface=surface_split_2, Curves=line)  # -> flatten(Fragments)

surface_section = SurfaceSection(Name="Shell", Thickness=Slider(0.8, range=0..1))
line_mesh = LineMesh(Name="ThickBeam", Length=Slider(3, range=0.25..5), Stored_MeshElementOrder="Linear", Stored_MeshType="ThickBeam")
parametric_section = ParametricSection(Name="Posts", D=Slider(1.5, range=0.1..3), Stored_SectionSubType="Solid", Stored_SectionType="Circular")  # -> Section, Area
library_material = LibraryMaterial(
    Name="Concrete",
    Stored_Material_Grade="C40/50",
    Stored_Material_Region="Europe",
    Stored_Material_Standard="EN1992-1-1:2004/2014",
    Stored_Material_Type="Concrete")  # -> Material, Density
line_member = LineMember(Curve=[line_5, line_4], Material=library_material.Material, Section=parametric_section.Section, Mesh=line_mesh)
support = Support(Name="Fixity", TransSprings=Vector(0, 0, 0), RotSprings=Vector(0, 0, 0))
point = Point(end_points.End)
gravity = Gravity(Factor=1, Loadcase="LC1")
analysis = Analysis(Name="A1", Loadcases="LC1", Gravity=gravity, Stored_IsBaseAnalysis=True)
assign_point_support = AssignPointSupport(Point=point, Support=support, Analysis="A1")
surface_mesh = SurfaceMesh(
    Name="QTS4",
    Size=Slider(3, range=0.5..5),
    Stored_MeshElementOrder="Linear",
    Stored_MeshShape="Quadrilateral",
    Stored_MeshType="ThickShell",
    Stored_Regularity=0)
surface_member = SurfaceMember(Brep=surface_split_3, Material=library_material.Material, Section=surface_section, Mesh=surface_mesh)
lusas_model = LUSASModel(Member=[surface_member, line_member], Analyses=analysis, Assignments=assign_point_support, Stored_Units="N,m,kg,s,C")
model_preview = ModelPreview(
    Model=lusas_model,
    Stored_Analysis="A1",
    Stored_Loadcase="LC1",
    Stored_PreviewLoads=True,
    Stored_PreviewSections=True,
    Stored_PreviewSupports=True,
    Stored_Scale=1)
live_link = LiveLink(
    Model=lusas_model,
    Run=Toggle(False),
    Stored_LastBrowsedDirectory="C:\Users\paulbd\Desktop\GRASSHOPPER\250331",
    Stored_LastExportFilename="CoolingTower.mdl",
    Stored_LinkMode=0)
