# Grasshopper definition 02_LUSAS_GH_CurvedPlateGirderBridge.gh (Grasshopper 1.0.8)
# plug-ins: LUSAS_Grasshopper

# ----
# Radius of Curvature
# Length
# Girder Spacing
# Support Locations
# Splice Locations
# Web Depth
# Cross-Frame Locations
length = Slider(517.5, range=0..1000)
spacing = Slider(11, range=0..100)
support_2 = Slider(0.302, range=0..1)
support_3 = Slider(0.698, range=0..1)
support_4 = Slider(1, range=0..1)
splice_1 = Slider(0.219, range=0..100)
splice_3 = Slider(0.619, range=0..1)
splice_4 = Slider(0.781, range=0..1)
radius = Slider(683.5, range=0..1000)
support_1 = Slider(0, range=0..100)
splice_2 = Slider(0.381, range=0..1)
web_depth = Slider(84, range=0..100)

division = Division(A=length, B=radius)
addition = Addition(A=radius, B=spacing)
addition_2 = Addition(A=addition, B=spacing)
addition_3 = Addition(A=addition_2, B=spacing)
arc = Arc(Plane=PlaneXY(0, 0, 0), Radius=radius, Angle=division)  # -> Arc, Length
arc_2 = Arc(Plane=PlaneXY(0, 0, 0), Radius=addition, Angle=division)  # -> Arc, Length
arc_3 = Arc(Plane=PlaneXY(0, 0, 0), Radius=addition_2, Angle=division)  # -> Arc, Length
arc_4 = Arc(Plane=PlaneXY(0, 0, 0), Radius=addition_3, Angle=division)  # -> Arc, Length
create_set = CreateSet(List=[support_1, support_2, support_3, support_4])  # -> Set, Map
create_set_2 = CreateSet(List=[splice_1, splice_2, splice_3, splice_4])  # -> Set, Map
create_set_3 = CreateSet(List=[Slider(0, range=0..100), Slider(0.038, range=0..0.1), Slider(0.076, range=0..0.1), Slider(0.113, range=0..1), Slider(0.151, range=0..1), Slider(0.189, range=0..1), Slider(0.226, range=0..1), Slider(0.264, range=0..1), Slider(0.302, range=0..1), Slider(0.338, range=0..1), Slider(0.374, range=0..1), Slider(0.41, range=0..1), Slider(0.446, range=0..1), Slider(0.482, range=0..1), Slider(0.518, range=0..1), Slider(0.554, range=0..1), Slider(0.59, range=0..1), Slider(0.626, range=0..1), Slider(0.662, range=0..1), Slider(0.698, range=0..1), Slider(0.736, range=0..1), Slider(0.774, range=0..1), Slider(0.811, range=0..1), Slider(0.849, range=0..1), Slider(0.887, range=0..1), Slider(0.925, range=0..1), Slider(0.962, range=0..1), Slider(1, range=0..1)])  # -> Set, Map
multiplication = Multiplication(A=arc.Length, B=create_set.Set)
multiplication_2 = Multiplication(A=arc_2.Length, B=create_set.Set)
multiplication_3 = Multiplication(A=arc_3.Length, B=create_set.Set)
multiplication_4 = Multiplication(A=arc_4.Length, B=create_set.Set)
multiplication_5 = Multiplication(A=arc.Length, B=create_set_2.Set)
multiplication_6 = Multiplication(A=arc_2.Length, B=create_set_2.Set)
multiplication_7 = Multiplication(A=arc_3.Length, B=create_set_2.Set)
multiplication_8 = Multiplication(A=arc_4.Length, B=create_set_3.Set)
multiplication_9 = Multiplication(A=arc.Length, B=create_set_3.Set)
multiplication_10 = Multiplication(A=arc_2.Length, B=create_set_3.Set)
multiplication_11 = Multiplication(A=arc_4.Length, B=create_set_2.Set)
multiplication_12 = Multiplication(A=arc_3.Length, B=create_set_3.Set)
shatter = Shatter(Curve=arc.Arc, Parameters=multiplication)  # -> flatten(Segments)
shatter_2 = Shatter(Curve=arc_2.Arc, Parameters=multiplication_2)  # -> flatten(Segments)
shatter_3 = Shatter(Curve=arc_3.Arc, Parameters=multiplication_3)  # -> flatten(Segments)
shatter_4 = Shatter(Curve=arc.Arc, Parameters=multiplication_5)  # -> flatten(Segments)
shatter_5 = Shatter(Curve=arc_4.Arc, Parameters=multiplication_4)  # -> flatten(Segments)
shatter_6 = Shatter(Curve=arc_2.Arc, Parameters=multiplication_6)  # -> flatten(Segments)
shatter_7 = Shatter(Curve=arc_3.Arc, Parameters=multiplication_7)  # -> flatten(Segments)
shatter_8 = Shatter(Curve=arc_4.Arc, Parameters=multiplication_11)  # -> flatten(Segments)
shatter_9 = Shatter(Curve=arc_2.Arc, Parameters=[multiplication_10, multiplication_6])
shatter_10 = Shatter(Curve=arc_3.Arc, Parameters=[multiplication_12, multiplication_7])
shatter_11 = Shatter(Curve=arc_4.Arc, Parameters=[multiplication_8, multiplication_11])
shatter_12 = Shatter(Curve=arc.Arc, Parameters=[multiplication_9, multiplication_5])
rebuild_curve = RebuildCurve(Curve=shatter_12, Degree="2", Count=10, Tangents=False)
rebuild_curve_2 = RebuildCurve(Curve=shatter_9, Degree="2", Count=10, Tangents=False)
rebuild_curve_3 = RebuildCurve(Curve=shatter_10, Degree="2", Count=10, Tangents=False)
rebuild_curve_4 = RebuildCurve(Curve=shatter_11, Degree="2", Count=10, Tangents=False)
end_points = EndPoints(Curve=shatter_5)  # -> Start, End
end_points_2 = EndPoints(Curve=shatter)  # -> Start, End
end_points_3 = EndPoints(Curve=shatter_2)  # -> Start, End
end_points_4 = EndPoints(Curve=shatter_3)  # -> Start, End
list_item = ListItem(List=end_points_2.Start, Index=0, Wrap=True)
list_item_2 = ListItem(List=end_points_3.Start, Index=0, Wrap=True)
list_item_3 = ListItem(List=end_points_4.Start, Index=0, Wrap=True)
list_item_4 = ListItem(List=end_points.Start, Index=0, Wrap=True)
shatter_13 = Shatter(Curve=arc_3.Arc, Parameters=multiplication_12)
shatter_14 = Shatter(Curve=arc_4.Arc, Parameters=multiplication_8)
shatter_15 = Shatter(Curve=arc.Arc, Parameters=multiplication_9)
shatter_16 = Shatter(Curve=arc_2.Arc, Parameters=multiplication_10)
end_points_5 = EndPoints(Curve=shatter_14)  # -> Start, End
end_points_6 = EndPoints(Curve=shatter_13)  # -> Start, End
division_2 = Division(A=web_depth, B="12")
end_points_7 = EndPoints(Curve=shatter_15)  # -> Start, End
end_points_8 = EndPoints(Curve=shatter_16)  # -> Start, End
list_item_5 = ListItem(List=end_points_6.End, Index="-1", Wrap=True)
list_item_6 = ListItem(List=end_points_8.End, Index="-1", Wrap=True)
list_item_7 = ListItem(List=end_points_7.End, Index="-1", Wrap=True)
list_item_8 = ListItem(List=end_points_5.End, Index="-1", Wrap=True)
vector_xyz = VectorXYZ(XComponent=0, YComponent=0, ZComponent=division_2)  # -> Vector, Length
move = Move(Geometry=shatter_6, Motion=vector_xyz.Vector)  # -> Geometry, Transform
move_2 = Move(Geometry=shatter_4, Motion=vector_xyz.Vector)  # -> Geometry, Transform
move_3 = Move(Geometry=shatter_8, Motion=vector_xyz.Vector)  # -> Geometry, Transform
move_4 = Move(Geometry=rebuild_curve_3, Motion=vector_xyz.Vector)  # -> Geometry, Transform
move_5 = Move(Geometry=shatter_7, Motion=vector_xyz.Vector)  # -> Geometry, Transform
move_6 = Move(Geometry=rebuild_curve_4, Motion=vector_xyz.Vector)  # -> Geometry, Transform
move_7 = Move(Geometry=rebuild_curve_2, Motion=vector_xyz.Vector)  # -> Geometry, Transform
move_8 = Move(Geometry=rebuild_curve, Motion=vector_xyz.Vector)  # -> Geometry, Transform
ruled_surface = RuledSurface(CurveA=rebuild_curve, CurveB=move_8.Geometry)
ruled_surface_2 = RuledSurface(CurveA=rebuild_curve_2, CurveB=move_7.Geometry)
ruled_surface_3 = RuledSurface(CurveA=rebuild_curve_3, CurveB=move_4.Geometry)
ruled_surface_4 = RuledSurface(CurveA=rebuild_curve_4, CurveB=move_6.Geometry)
move_9 = Move(Geometry=list_item_5, Motion=vector_xyz.Vector)  # -> Geometry, Transform
move_10 = Move(Geometry=list_item_6, Motion=vector_xyz.Vector)  # -> Geometry, Transform
move_11 = Move(Geometry=list_item_8, Motion=vector_xyz.Vector)  # -> Geometry, Transform
move_12 = Move(Geometry=list_item_7, Motion=vector_xyz.Vector)  # -> Geometry, Transform
line = Line(StartPoint=list_item_5, EndPoint=move_9.Geometry)
line_2 = Line(StartPoint=list_item_8, EndPoint=move_11.Geometry)
line_3 = Line(StartPoint=list_item_6, EndPoint=move_10.Geometry)
line_4 = Line(StartPoint=end_points_6.Start, EndPoint=end_points_5.Start)
line_5 = Line(StartPoint=list_item_7, EndPoint=move_12.Geometry)
line_6 = Line(StartPoint=end_points_8.Start, EndPoint=end_points_6.Start)
line_7 = Line(StartPoint=end_points_7.Start, EndPoint=end_points_8.Start)
list_item_9 = ListItem(List=end_points_8.End, Index="-1", Wrap=True)
list_item_10 = ListItem(List=end_points_7.End, Index="-1", Wrap=True)
list_item_11 = ListItem(List=end_points_5.End, Index="-1", Wrap=True)
list_item_12 = ListItem(List=end_points_6.End, Index="-1", Wrap=True)
line_8 = Line(StartPoint=list_item_10, EndPoint=list_item_9)
line_9 = Line(StartPoint=list_item_9, EndPoint=list_item_12)
line_10 = Line(StartPoint=list_item_12, EndPoint=list_item_11)
move_13 = Move(Geometry=list_item_11, Motion=vector_xyz.Vector)  # -> Geometry, Transform
move_14 = Move(Geometry=list_item_10, Motion=vector_xyz.Vector)  # -> Geometry, Transform
move_15 = Move(Geometry=list_item_9, Motion=vector_xyz.Vector)  # -> Geometry, Transform
move_16 = Move(Geometry=list_item_12, Motion=vector_xyz.Vector)  # -> Geometry, Transform
line_11 = Line(StartPoint=list_item_9, EndPoint=move_16.Geometry)
line_12 = Line(StartPoint=list_item_10, EndPoint=move_15.Geometry)
line_13 = Line(StartPoint=list_item_12, EndPoint=move_13.Geometry)
move_17 = Move(Geometry=end_points_6.Start, Motion=vector_xyz.Vector)  # -> Geometry, Transform
line_14 = Line(StartPoint=end_points_8.Start, EndPoint=move_17.Geometry)
move_18 = Move(Geometry=end_points_5.Start, Motion=vector_xyz.Vector)  # -> Geometry, Transform
line_15 = Line(StartPoint=end_points_6.Start, EndPoint=move_18.Geometry)
move_19 = Move(Geometry=end_points_8.Start, Motion=vector_xyz.Vector)  # -> Geometry, Transform
line_16 = Line(StartPoint=end_points_7.Start, EndPoint=move_19.Geometry)
move_20 = Move(Geometry=end_points_7.Start, Motion=vector_xyz.Vector)  # -> Geometry, Transform
line_17 = Line(StartPoint=move_17.Geometry, EndPoint=move_18.Geometry)
line_18 = Line(StartPoint=move_17.Geometry, EndPoint=end_points_5.Start)
line_19 = Line(StartPoint=move_19.Geometry, EndPoint=end_points_6.Start)
line_20 = Line(StartPoint=move_20.Geometry, EndPoint=end_points_8.Start)
line_21 = Line(StartPoint=move_19.Geometry, EndPoint=move_17.Geometry)
line_22 = Line(StartPoint=move_20.Geometry, EndPoint=move_19.Geometry)
line_23 = Line(StartPoint=move_16.Geometry, EndPoint=move_13.Geometry)
line_24 = Line(StartPoint=move_14.Geometry, EndPoint=list_item_9)
line_25 = Line(StartPoint=move_15.Geometry, EndPoint=list_item_12)
line_26 = Line(StartPoint=move_16.Geometry, EndPoint=list_item_11)
line_27 = Line(StartPoint=end_points_6.Start, EndPoint=move_17.Geometry)
line_28 = Line(StartPoint=end_points_5.Start, EndPoint=move_18.Geometry)
line_29 = Line(StartPoint=move_15.Geometry, EndPoint=move_16.Geometry)
line_30 = Line(StartPoint=move_14.Geometry, EndPoint=move_15.Geometry)
line_31 = Line(StartPoint=end_points_8.Start, EndPoint=move_19.Geometry)
line_32 = Line(StartPoint=end_points_7.Start, EndPoint=move_20.Geometry)
line_33 = Line([line_7, line_8])
line_34 = Line([line_22, line_30])
line_35 = Line([line_4, line_10])
line_36 = Line([line_5, line_3, line, line_2])
line_37 = Line([line_21, line_29])
line_38 = Line([line_6, line_9])
line_39 = Line([line_17, line_23])
line_40 = Line([line_16, line_12, line_14, line_11, line_15, line_13])
line_41 = Line([line_20, line_24, line_19, line_25, line_18, line_26])

stiffener_thickness = Slider(0.875, range=0..1)
stiffener_width = Slider(18, range=0..100)
web_thickness = Slider(0.625, range=0..2)
thickness = Slider(0.75, range=0..10)
depth = Slider(5, range=0..10)
division_3 = Division(A=web_thickness, B="12")
division_4 = Division(A=stiffener_thickness, B="12")
division_5 = Division(A=depth, B="12")
division_6 = Division(A=stiffener_width, B="12")
division_7 = Division(A=thickness, B="12")
library_material = LibraryMaterial(
    Name="Steel",
    Stored_Material_Grade="Ungraded",
    Stored_Material_Region="USA",
    Stored_Material_Standard="AASHTO LRFD 4th-9th",
    Stored_Material_Type="Steel - Structural")  # -> Material, Density
line_mesh = LineMesh(Name="M_X-frames", Divisions="1", Stored_MeshElementOrder="Linear", Stored_MeshType="Bar")
surface_section = SurfaceSection(Name="S_Webs", Thickness=division_3)
parametric_section = ParametricSection(
    Name="X-frames",
    B=division_5,
    D=division_5,
    Tf=division_7,
    Tw=division_7,
    Stored_SectionSubType="Standard",
    Stored_SectionType="L")  # -> Section, Area
parametric_section_2 = ParametricSection(Name="Stiffeners", B=division_6, D=division_4, Stored_SectionSubType="Solid", Stored_SectionType="Rectangular")  # -> Section, Area
surface = Surface([ruled_surface, ruled_surface_2, ruled_surface_3, ruled_surface_4])
line_42 = Line([line_33, line_38, line_35, line_34, line_37, line_39])
line_43 = Line([line_40, line_41])
line_44 = Line([line_32, line_31, line_27, line_28, line_36])
line_member = LineMember(Curve=[line_42, line_43], Material=library_material.Material, Section=parametric_section.Section, Mesh=line_mesh)
line_mesh_2 = LineMesh(Name="M_Stiffeners", Divisions="4", Stored_MeshElementOrder="Quadratic", Stored_MeshType="ThickBeam")
line_member_2 = LineMember(Curve=line_44, Material=library_material.Material, Section=parametric_section_2.Section, Mesh=line_mesh_2)
mesh_size = Slider(2, range=0..10)
line_mesh_3 = LineMesh(Name="M_Flanges", Length=mesh_size, Stored_MeshElementOrder="Quadratic", Stored_MeshType="ThickBeam")
gravity = Gravity(Factor=1, Loadcase="LC1")
support = Support(Name="Roller", TransSprings=Vector(0, 0, 0), RotSprings=Vector(0, 0, 0))
support_5 = Support(Name="Pin", TransSprings=Vector(0, 0, 0), RotSprings=Vector(0, 0, 0))
point = Point([end_points_2.End, end_points_3.End, end_points_4.End, end_points.End])
mesh_size_2 = Slider(2, range=0..5)
point_2 = Point([list_item, list_item_2, list_item_3, list_item_4])
analysis = Analysis(Name="A1", Loadcases="LC1", Gravity=gravity, Stored_IsBaseAnalysis=True)
assign_point_support = AssignPointSupport(Point=point, Support=support)
assign_point_support_2 = AssignPointSupport(Point=point_2, Support=support_5)
surface_mesh = SurfaceMesh(
    Name="M_Webs",
    Size=mesh_size_2,
    Stored_MeshElementOrder="Quadratic",
    Stored_MeshShape="Quadrilateral",
    Stored_MeshType="ThickShell",
    Stored_Regularity=1)
surface_member = SurfaceMember(Brep=surface, Material=library_material.Material, Section=surface_section, Mesh=surface_mesh)
panel = Panel("""redim setOrigin(2)
setOrigin(0) = 0.0
setOrigin(1) = 0.0
setOrigin(2) = 0.0
redim matrixCol0(2)
matrixCol0(0) = 1.0
matrixCol0(1) = 0.0
matrixCol0(2) = 0.0
redim matrixCol1(2)
matrixCol1(0) = 0.0
matrixCol1(1) = 1.0
matrixCol1(2) = 0.0
redim matrixCol2(2)
matrixCol2(0) = 0.0
matrixCol2(1) = 0.0
matrixCol2(2) = 1.0
set attr = database.createLocalCylindricalAttr("LCrd1", setOrigin, matrixCol0, matrixCol1, matrixCol2)
call attr.setAxesType("Z_Cylindrical")
redim FEAtemp1(2)
FEAtemp1(0) = 0.0
FEAtemp1(1) = 0.0
FEAtemp1(2) = 1.0
call attr.setCylindricalDefnData("z", 0.0, FEAtemp1)
erase FEAtemp1
set attr = nothing
set attr = database.getAttribute("Structural Support", "Roller")
call assignment.setIgnoreAll()
call selection.add(attr)
set attr = nothing
'selection now contains:;P17;P18;P39;P40;P55;P56;P74;P96;P112;P130;P152;P168
set attr = database.getAttribute("Line Mesh", "M_Stiffeners")
call assignment.setIgnoreAll()
call selection.add(attr)
set attr = nothing
'selection now contains more than 50 items
call assignment.setAllDefaults()
call assignment.setLoadset("LC1")
call database.getAttribute("Local Coordinates", "LCrd1").assignTo(selection, assignment)
call selection.remove("All")""")

# ----
# BOTTOM FLANGES
width = Slider(18, range=0..100)
thickness_2 = Slider(1.5, range=0..10)
width_2 = Slider(18, range=0..100)
thickness_3 = Slider(1.5, range=0..10)
width_3 = Slider(18, range=0..100)
thickness_4 = Slider(1.5, range=0..10)
width_4 = Slider(18, range=0..100)
thickness_5 = Slider(1.5, range=0..10)
division_8 = Division(A=width, B="12")
curve = Curve(shatter_4)
division_9 = Division(A=thickness_2, B="12")
division_10 = Division(A=width_2, B="12")
curve_2 = Curve(shatter_6)
division_11 = Division(A=thickness_3, B="12")
division_12 = Division(A=width_3, B="12")
curve_3 = Curve(shatter_7)
division_13 = Division(A=thickness_4, B="12")
division_14 = Division(A=width_4, B="12")
curve_4 = Curve(shatter_8)
division_15 = Division(A=thickness_5, B="12")
list_item_13 = ListItem(List=curve, Index="0", Wrap=True)
list_item_14 = ListItem(List=curve_2, Index="0", Wrap=True)
parametric_section_3 = ParametricSection(Name="G1_BF1", B=division_8, D=division_9, Stored_SectionSubType="Solid", Stored_SectionType="Rectangular")  # -> Section, Area
list_item_15 = ListItem(List=curve_3, Index="0", Wrap=True)
parametric_section_4 = ParametricSection(Name="G2_BF1", B=division_10, D=division_11, Stored_SectionSubType="Solid", Stored_SectionType="Rectangular")  # -> Section, Area
parametric_section_5 = ParametricSection(Name="G3_BF1", B=division_12, D=division_13, Stored_SectionSubType="Solid", Stored_SectionType="Rectangular")  # -> Section, Area
list_item_16 = ListItem(List=curve_4, Index="0", Wrap=True)
parametric_section_6 = ParametricSection(Name="G4_BF1", B=division_14, D=division_15, Stored_SectionSubType="Solid", Stored_SectionType="Rectangular")  # -> Section, Area
division_16 = Division(A=division_9, B="2")
division_17 = Division(A=division_11, B="2")
curve_closest_point = CurveClosestPoint(Point=end_points_7.Start, Curve=list_item_13)  # -> Point, Parameter, Distance
division_18 = Division(A=division_13, B="2")
curve_closest_point_2 = CurveClosestPoint(Point=end_points_7.Start, Curve=list_item_14)  # -> Point, Parameter, Distance
division_19 = Division(A=division_15, B="2")
curve_closest_point_3 = CurveClosestPoint(Point=end_points_7.Start, Curve=list_item_15)  # -> Point, Parameter, Distance
assign_section = AssignSection(Section=parametric_section_3.Section, EccZ=division_16, EccY=0)
curve_closest_point_4 = CurveClosestPoint(Point=end_points_7.Start, Curve=list_item_16)  # -> Point, Parameter, Distance
assign_section_2 = AssignSection(Section=parametric_section_4.Section, EccZ=division_17, EccY=0)
assign_section_3 = AssignSection(Section=parametric_section_5.Section, EccZ=division_18, EccY=0)
shatter_17 = Shatter(Curve=list_item_13, Parameters=curve_closest_point.Parameter)
assign_section_4 = AssignSection(Section=parametric_section_6.Section, EccZ=division_19, EccY=0)
shatter_18 = Shatter(Curve=list_item_14, Parameters=curve_closest_point_2.Parameter)
shatter_19 = Shatter(Curve=list_item_15, Parameters=curve_closest_point_3.Parameter)
shatter_20 = Shatter(Curve=list_item_16, Parameters=curve_closest_point_4.Parameter)
rebuild_curve_5 = RebuildCurve(Curve=shatter_17, Degree="2", Count=10, Tangents=False)
line_member_3 = LineMember(Curve=rebuild_curve_5, Material=library_material.Material, Section=assign_section, Mesh=line_mesh_3)
rebuild_curve_6 = RebuildCurve(Curve=shatter_18, Degree="2", Count=10, Tangents=False)
line_member_4 = LineMember(Curve=rebuild_curve_6, Material=library_material.Material, Section=assign_section_2, Mesh=line_mesh_3)
rebuild_curve_7 = RebuildCurve(Curve=shatter_19, Degree="2", Count=10, Tangents=False)
line_member_5 = LineMember(Curve=rebuild_curve_7, Material=library_material.Material, Section=assign_section_3, Mesh=line_mesh_3)
rebuild_curve_8 = RebuildCurve(Curve=shatter_20, Degree="2", Count=10, Tangents=False)
line_member_6 = LineMember(Curve=rebuild_curve_8, Material=library_material.Material, Section=assign_section_4, Mesh=line_mesh_3)
width_5 = Slider(21, range=0..100)
thickness_6 = Slider(2.5, range=0..10)
width_6 = Slider(21, range=0..100)
thickness_7 = Slider(2.5, range=0..10)
width_7 = Slider(21, range=0..100)
thickness_8 = Slider(2.5, range=0..10)
width_8 = Slider(21, range=0..100)
thickness_9 = Slider(2.5, range=0..10)
division_20 = Division(A=width_5, B="12")
curve_5 = Curve(shatter_4)
division_21 = Division(A=thickness_6, B="12")
division_22 = Division(A=width_6, B="12")
curve_6 = Curve(shatter_6)
division_23 = Division(A=thickness_7, B="12")
division_24 = Division(A=width_7, B="12")
curve_7 = Curve(shatter_7)
division_25 = Division(A=thickness_8, B="12")
division_26 = Division(A=width_8, B="12")
curve_8 = Curve(shatter_8)
division_27 = Division(A=thickness_9, B="12")
list_item_17 = ListItem(List=curve_5, Index="1", Wrap=True)
list_item_18 = ListItem(List=curve_6, Index="1", Wrap=True)
parametric_section_7 = ParametricSection(Name="G1_BF2", B=division_20, D=division_21, Stored_SectionSubType="Solid", Stored_SectionType="Rectangular")  # -> Section, Area
list_item_19 = ListItem(List=curve_7, Index="1", Wrap=True)
parametric_section_8 = ParametricSection(Name="G2_BF2", B=division_22, D=division_23, Stored_SectionSubType="Solid", Stored_SectionType="Rectangular")  # -> Section, Area
parametric_section_9 = ParametricSection(Name="G3_BF2", B=division_24, D=division_25, Stored_SectionSubType="Solid", Stored_SectionType="Rectangular")  # -> Section, Area
list_item_20 = ListItem(List=curve_8, Index="1", Wrap=True)
parametric_section_10 = ParametricSection(Name="G4_BF2", B=division_26, D=division_27, Stored_SectionSubType="Solid", Stored_SectionType="Rectangular")  # -> Section, Area
division_28 = Division(A=division_21, B="2")
division_29 = Division(A=division_23, B="2")
curve_closest_point_5 = CurveClosestPoint(Point=end_points_7.Start, Curve=list_item_17)  # -> Point, Parameter, Distance
division_30 = Division(A=division_25, B="2")
curve_closest_point_6 = CurveClosestPoint(Point=end_points_7.Start, Curve=list_item_18)  # -> Point, Parameter, Distance
division_31 = Division(A=division_27, B="2")
curve_closest_point_7 = CurveClosestPoint(Point=end_points_7.Start, Curve=list_item_19)  # -> Point, Parameter, Distance
assign_section_5 = AssignSection(Section=parametric_section_7.Section, EccZ=division_28, EccY=0)
curve_closest_point_8 = CurveClosestPoint(Point=end_points_7.Start, Curve=list_item_20)  # -> Point, Parameter, Distance
assign_section_6 = AssignSection(Section=parametric_section_8.Section, EccZ=division_29, EccY=0)
assign_section_7 = AssignSection(Section=parametric_section_9.Section, EccZ=division_30, EccY=0)
shatter_21 = Shatter(Curve=list_item_17, Parameters=curve_closest_point_5.Parameter)
assign_section_8 = AssignSection(Section=parametric_section_10.Section, EccZ=division_31, EccY=0)
shatter_22 = Shatter(Curve=list_item_18, Parameters=curve_closest_point_6.Parameter)
shatter_23 = Shatter(Curve=list_item_19, Parameters=curve_closest_point_7.Parameter)
shatter_24 = Shatter(Curve=list_item_20, Parameters=curve_closest_point_8.Parameter)
rebuild_curve_9 = RebuildCurve(Curve=shatter_21, Degree="2", Count=10, Tangents=False)
line_member_7 = LineMember(Curve=rebuild_curve_9, Material=library_material.Material, Section=assign_section_5, Mesh=line_mesh_3)
rebuild_curve_10 = RebuildCurve(Curve=shatter_22, Degree="2", Count=10, Tangents=False)
line_member_8 = LineMember(Curve=rebuild_curve_10, Material=library_material.Material, Section=assign_section_6, Mesh=line_mesh_3)
rebuild_curve_11 = RebuildCurve(Curve=shatter_23, Degree="2", Count=10, Tangents=False)
line_member_9 = LineMember(Curve=rebuild_curve_11, Material=library_material.Material, Section=assign_section_7, Mesh=line_mesh_3)
rebuild_curve_12 = RebuildCurve(Curve=shatter_24, Degree="2", Count=10, Tangents=False)
line_member_10 = LineMember(Curve=rebuild_curve_12, Material=library_material.Material, Section=assign_section_8, Mesh=line_mesh_3)
width_9 = Slider(18, range=0..100)
thickness_10 = Slider(1.5, range=0..10)
width_10 = Slider(18, range=0..100)
thickness_11 = Slider(1.5, range=0..10)
width_11 = Slider(18, range=0..100)
thickness_12 = Slider(1.5, range=0..10)
width_12 = Slider(18, range=0..100)
thickness_13 = Slider(1.5, range=0..10)
division_32 = Division(A=width_9, B="12")
curve_9 = Curve(shatter_4)
division_33 = Division(A=thickness_10, B="12")
division_34 = Division(A=width_10, B="12")
curve_10 = Curve(shatter_6)
division_35 = Division(A=thickness_11, B="12")
division_36 = Division(A=width_11, B="12")
curve_11 = Curve(shatter_7)
division_37 = Division(A=thickness_12, B="12")
division_38 = Division(A=width_12, B="12")
curve_12 = Curve(shatter_8)
division_39 = Division(A=thickness_13, B="12")
list_item_21 = ListItem(List=curve_9, Index="2", Wrap=True)
list_item_22 = ListItem(List=curve_10, Index="2", Wrap=True)
parametric_section_11 = ParametricSection(Name="G1_BF3", B=division_32, D=division_33, Stored_SectionSubType="Solid", Stored_SectionType="Rectangular")  # -> Section, Area
list_item_23 = ListItem(List=curve_11, Index="2", Wrap=True)
parametric_section_12 = ParametricSection(Name="G2_BF3", B=division_34, D=division_35, Stored_SectionSubType="Solid", Stored_SectionType="Rectangular")  # -> Section, Area
parametric_section_13 = ParametricSection(Name="G3_BF3", B=division_36, D=division_37, Stored_SectionSubType="Solid", Stored_SectionType="Rectangular")  # -> Section, Area
list_item_24 = ListItem(List=curve_12, Index="2", Wrap=True)
parametric_section_14 = ParametricSection(Name="G4_BF3", B=division_38, D=division_39, Stored_SectionSubType="Solid", Stored_SectionType="Rectangular")  # -> Section, Area
division_40 = Division(A=division_33, B="2")
division_41 = Division(A=division_35, B="2")
curve_closest_point_9 = CurveClosestPoint(Point=end_points_7.Start, Curve=list_item_21)  # -> Point, Parameter, Distance
division_42 = Division(A=division_37, B="2")
curve_closest_point_10 = CurveClosestPoint(Point=end_points_7.Start, Curve=list_item_22)  # -> Point, Parameter, Distance
division_43 = Division(A=division_39, B="2")
curve_closest_point_11 = CurveClosestPoint(Point=end_points_7.Start, Curve=list_item_23)  # -> Point, Parameter, Distance
assign_section_9 = AssignSection(Section=parametric_section_11.Section, EccZ=division_40, EccY=0)
curve_closest_point_12 = CurveClosestPoint(Point=end_points_7.Start, Curve=list_item_24)  # -> Point, Parameter, Distance
assign_section_10 = AssignSection(Section=parametric_section_12.Section, EccZ=division_41, EccY=0)
assign_section_11 = AssignSection(Section=parametric_section_13.Section, EccZ=division_42, EccY=0)
shatter_25 = Shatter(Curve=list_item_21, Parameters=curve_closest_point_9.Parameter)
assign_section_12 = AssignSection(Section=parametric_section_14.Section, EccZ=division_43, EccY=0)
shatter_26 = Shatter(Curve=list_item_22, Parameters=curve_closest_point_10.Parameter)
shatter_27 = Shatter(Curve=list_item_23, Parameters=curve_closest_point_11.Parameter)
shatter_28 = Shatter(Curve=list_item_24, Parameters=curve_closest_point_12.Parameter)
rebuild_curve_13 = RebuildCurve(Curve=shatter_25, Degree="2", Count=10, Tangents=False)
line_member_11 = LineMember(Curve=rebuild_curve_13, Material=library_material.Material, Section=assign_section_9, Mesh=line_mesh_3)
rebuild_curve_14 = RebuildCurve(Curve=shatter_26, Degree="2", Count=10, Tangents=False)
line_member_12 = LineMember(Curve=rebuild_curve_14, Material=library_material.Material, Section=assign_section_10, Mesh=line_mesh_3)
rebuild_curve_15 = RebuildCurve(Curve=shatter_27, Degree="2", Count=10, Tangents=False)
line_member_13 = LineMember(Curve=rebuild_curve_15, Material=library_material.Material, Section=assign_section_11, Mesh=line_mesh_3)
rebuild_curve_16 = RebuildCurve(Curve=shatter_28, Degree="2", Count=10, Tangents=False)
line_member_14 = LineMember(Curve=rebuild_curve_16, Material=library_material.Material, Section=assign_section_12, Mesh=line_mesh_3)
width_13 = Slider(21, range=0..100)
thickness_14 = Slider(2.5, range=0..10)
width_14 = Slider(21, range=0..100)
thickness_15 = Slider(2.5, range=0..10)
width_15 = Slider(21, range=0..100)
thickness_16 = Slider(2.5, range=0..10)
width_16 = Slider(21, range=0..100)
thickness_17 = Slider(2.5, range=0..10)
division_44 = Division(A=width_13, B="12")
curve_13 = Curve(shatter_4)
division_45 = Division(A=thickness_14, B="12")
division_46 = Division(A=width_14, B="12")
curve_14 = Curve(shatter_6)
division_47 = Division(A=thickness_15, B="12")
division_48 = Division(A=width_15, B="12")
curve_15 = Curve(shatter_7)
division_49 = Division(A=thickness_16, B="12")
division_50 = Division(A=width_16, B="12")
curve_16 = Curve(shatter_8)
division_51 = Division(A=thickness_17, B="12")
list_item_25 = ListItem(List=curve_13, Index="3", Wrap=True)
list_item_26 = ListItem(List=curve_14, Index="3", Wrap=True)
parametric_section_15 = ParametricSection(Name="G1_BF4", B=division_44, D=division_45, Stored_SectionSubType="Solid", Stored_SectionType="Rectangular")  # -> Section, Area
list_item_27 = ListItem(List=curve_15, Index="3", Wrap=True)
parametric_section_16 = ParametricSection(Name="G2_BF4", B=division_46, D=division_47, Stored_SectionSubType="Solid", Stored_SectionType="Rectangular")  # -> Section, Area
parametric_section_17 = ParametricSection(Name="G3_BF4", B=division_48, D=division_49, Stored_SectionSubType="Solid", Stored_SectionType="Rectangular")  # -> Section, Area
list_item_28 = ListItem(List=curve_16, Index="3", Wrap=True)
parametric_section_18 = ParametricSection(Name="G4_BF4", B=division_50, D=division_51, Stored_SectionSubType="Solid", Stored_SectionType="Rectangular")  # -> Section, Area
division_52 = Division(A=division_45, B="2")
division_53 = Division(A=division_47, B="2")
curve_closest_point_13 = CurveClosestPoint(Point=end_points_7.Start, Curve=list_item_25)  # -> Point, Parameter, Distance
division_54 = Division(A=division_49, B="2")
curve_closest_point_14 = CurveClosestPoint(Point=end_points_7.Start, Curve=list_item_26)  # -> Point, Parameter, Distance
division_55 = Division(A=division_51, B="2")
curve_closest_point_15 = CurveClosestPoint(Point=end_points_7.Start, Curve=list_item_27)  # -> Point, Parameter, Distance
assign_section_13 = AssignSection(Section=parametric_section_15.Section, EccZ=division_52, EccY=0)
curve_closest_point_16 = CurveClosestPoint(Point=end_points_7.Start, Curve=list_item_28)  # -> Point, Parameter, Distance
assign_section_14 = AssignSection(Section=parametric_section_16.Section, EccZ=division_53, EccY=0)
assign_section_15 = AssignSection(Section=parametric_section_17.Section, EccZ=division_54, EccY=0)
shatter_29 = Shatter(Curve=list_item_25, Parameters=curve_closest_point_13.Parameter)
assign_section_16 = AssignSection(Section=parametric_section_18.Section, EccZ=division_55, EccY=0)
shatter_30 = Shatter(Curve=list_item_26, Parameters=curve_closest_point_14.Parameter)
shatter_31 = Shatter(Curve=list_item_27, Parameters=curve_closest_point_15.Parameter)
shatter_32 = Shatter(Curve=list_item_28, Parameters=curve_closest_point_16.Parameter)
rebuild_curve_17 = RebuildCurve(Curve=shatter_29, Degree="2", Count=10, Tangents=False)
line_member_15 = LineMember(Curve=rebuild_curve_17, Material=library_material.Material, Section=assign_section_13, Mesh=line_mesh_3)
rebuild_curve_18 = RebuildCurve(Curve=shatter_30, Degree="2", Count=10, Tangents=False)
line_member_16 = LineMember(Curve=rebuild_curve_18, Material=library_material.Material, Section=assign_section_14, Mesh=line_mesh_3)
rebuild_curve_19 = RebuildCurve(Curve=shatter_31, Degree="2", Count=10, Tangents=False)
line_member_17 = LineMember(Curve=rebuild_curve_19, Material=library_material.Material, Section=assign_section_15, Mesh=line_mesh_3)
rebuild_curve_20 = RebuildCurve(Curve=shatter_32, Degree="2", Count=10, Tangents=False)
line_member_18 = LineMember(Curve=rebuild_curve_20, Material=library_material.Material, Section=assign_section_16, Mesh=line_mesh_3)
width_17 = Slider(18, range=0..100)
thickness_18 = Slider(1.5, range=0..10)
width_18 = Slider(18, range=0..100)
thickness_19 = Slider(1.5, range=0..10)
width_19 = Slider(18, range=0..100)
thickness_20 = Slider(1.5, range=0..10)
width_20 = Slider(18, range=0..100)
thickness_21 = Slider(1.5, range=0..10)
division_56 = Division(A=width_17, B="12")
curve_17 = Curve(shatter_4)
division_57 = Division(A=thickness_18, B="12")
division_58 = Division(A=width_18, B="12")
curve_18 = Curve(shatter_6)
division_59 = Division(A=thickness_19, B="12")
division_60 = Division(A=width_19, B="12")
curve_19 = Curve(shatter_7)
division_61 = Division(A=thickness_20, B="12")
division_62 = Division(A=width_20, B="12")
curve_20 = Curve(shatter_8)
division_63 = Division(A=thickness_21, B="12")
list_item_29 = ListItem(List=curve_17, Index="4", Wrap=True)
list_item_30 = ListItem(List=curve_18, Index="4", Wrap=True)
parametric_section_19 = ParametricSection(Name="G1_BF5", B=division_56, D=division_57, Stored_SectionSubType="Solid", Stored_SectionType="Rectangular")  # -> Section, Area
list_item_31 = ListItem(List=curve_19, Index="4", Wrap=True)
parametric_section_20 = ParametricSection(Name="G2_BF5", B=division_58, D=division_59, Stored_SectionSubType="Solid", Stored_SectionType="Rectangular")  # -> Section, Area
parametric_section_21 = ParametricSection(Name="G3_BF5", B=division_60, D=division_61, Stored_SectionSubType="Solid", Stored_SectionType="Rectangular")  # -> Section, Area
list_item_32 = ListItem(List=curve_20, Index="4", Wrap=True)
parametric_section_22 = ParametricSection(Name="G4_BF5", B=division_62, D=division_63, Stored_SectionSubType="Solid", Stored_SectionType="Rectangular")  # -> Section, Area
division_64 = Division(A=division_57, B="2")
division_65 = Division(A=division_59, B="2")
curve_closest_point_17 = CurveClosestPoint(Point=end_points_7.Start, Curve=list_item_29)  # -> Point, Parameter, Distance
division_66 = Division(A=division_61, B="2")
curve_closest_point_18 = CurveClosestPoint(Point=end_points_7.Start, Curve=list_item_30)  # -> Point, Parameter, Distance
division_67 = Division(A=division_63, B="2")
curve_closest_point_19 = CurveClosestPoint(Point=end_points_7.Start, Curve=list_item_31)  # -> Point, Parameter, Distance
assign_section_17 = AssignSection(Section=parametric_section_19.Section, EccZ=division_64, EccY=0)
curve_closest_point_20 = CurveClosestPoint(Point=end_points_7.Start, Curve=list_item_32)  # -> Point, Parameter, Distance
assign_section_18 = AssignSection(Section=parametric_section_20.Section, EccZ=division_65, EccY=0)
assign_section_19 = AssignSection(Section=parametric_section_21.Section, EccZ=division_66, EccY=0)
shatter_33 = Shatter(Curve=list_item_29, Parameters=curve_closest_point_17.Parameter)
assign_section_20 = AssignSection(Section=parametric_section_22.Section, EccZ=division_67, EccY=0)
shatter_34 = Shatter(Curve=list_item_30, Parameters=curve_closest_point_18.Parameter)
shatter_35 = Shatter(Curve=list_item_31, Parameters=curve_closest_point_19.Parameter)
shatter_36 = Shatter(Curve=list_item_32, Parameters=curve_closest_point_20.Parameter)
rebuild_curve_21 = RebuildCurve(Curve=shatter_33, Degree="2", Count=10, Tangents=False)
line_member_19 = LineMember(Curve=rebuild_curve_21, Material=library_material.Material, Section=assign_section_17, Mesh=line_mesh_3)
rebuild_curve_22 = RebuildCurve(Curve=shatter_34, Degree="2", Count=10, Tangents=False)
line_member_20 = LineMember(Curve=rebuild_curve_22, Material=library_material.Material, Section=assign_section_18, Mesh=line_mesh_3)
rebuild_curve_23 = RebuildCurve(Curve=shatter_35, Degree="2", Count=10, Tangents=False)
line_member_21 = LineMember(Curve=rebuild_curve_23, Material=library_material.Material, Section=assign_section_19, Mesh=line_mesh_3)
rebuild_curve_24 = RebuildCurve(Curve=shatter_36, Degree="2", Count=10, Tangents=False)
line_member_22 = LineMember(Curve=rebuild_curve_24, Material=library_material.Material, Section=assign_section_20, Mesh=line_mesh_3)

# ----
# TOP FLANGES
width_21 = Slider(18, range=0..100)
thickness_22 = Slider(1, range=0..10)
width_22 = Slider(18, range=0..100)
thickness_23 = Slider(1, range=0..10)
width_23 = Slider(18, range=0..100)
thickness_24 = Slider(1, range=0..10)
width_24 = Slider(18, range=0..100)
thickness_25 = Slider(1, range=0..10)
division_68 = Division(A=width_21, B="12")
curve_21 = Curve(move_2.Geometry)
division_69 = Division(A=thickness_22, B="12")
division_70 = Division(A=width_22, B="12")
curve_22 = Curve(move.Geometry)
division_71 = Division(A=thickness_23, B="12")
division_72 = Division(A=width_23, B="12")
curve_23 = Curve(move_5.Geometry)
division_73 = Division(A=thickness_24, B="12")
division_74 = Division(A=width_24, B="12")
curve_24 = Curve(move_3.Geometry)
division_75 = Division(A=thickness_25, B="12")
list_item_33 = ListItem(List=curve_21, Index="0", Wrap=True)
list_item_34 = ListItem(List=curve_22, Index="0", Wrap=True)
parametric_section_23 = ParametricSection(Name="G1_TF1", B=division_68, D=division_69, Stored_SectionSubType="Solid", Stored_SectionType="Rectangular")  # -> Section, Area
list_item_35 = ListItem(List=curve_23, Index="0", Wrap=True)
parametric_section_24 = ParametricSection(Name="G2_TF1", B=division_70, D=division_71, Stored_SectionSubType="Solid", Stored_SectionType="Rectangular")  # -> Section, Area
parametric_section_25 = ParametricSection(Name="G3_TF1", B=division_72, D=division_73, Stored_SectionSubType="Solid", Stored_SectionType="Rectangular")  # -> Section, Area
list_item_36 = ListItem(List=curve_24, Index="0", Wrap=True)
parametric_section_26 = ParametricSection(Name="G4_TF1", B=division_74, D=division_75, Stored_SectionSubType="Solid", Stored_SectionType="Rectangular")  # -> Section, Area
division_76 = Division(A=division_69, B="-2")
division_77 = Division(A=division_71, B="-2")
curve_closest_point_21 = CurveClosestPoint(Point=end_points_7.Start, Curve=list_item_33)  # -> Point, Parameter, Distance
division_78 = Division(A=division_73, B="-2")
curve_closest_point_22 = CurveClosestPoint(Point=end_points_7.Start, Curve=list_item_34)  # -> Point, Parameter, Distance
division_79 = Division(A=division_75, B="-2")
curve_closest_point_23 = CurveClosestPoint(Point=end_points_7.Start, Curve=list_item_35)  # -> Point, Parameter, Distance
assign_section_21 = AssignSection(Section=parametric_section_23.Section, EccZ=division_76, EccY=0)
curve_closest_point_24 = CurveClosestPoint(Point=end_points_7.Start, Curve=list_item_36)  # -> Point, Parameter, Distance
assign_section_22 = AssignSection(Section=parametric_section_24.Section, EccZ=division_77, EccY=0)
assign_section_23 = AssignSection(Section=parametric_section_25.Section, EccZ=division_78, EccY=0)
shatter_37 = Shatter(Curve=list_item_33, Parameters=curve_closest_point_21.Parameter)
assign_section_24 = AssignSection(Section=parametric_section_26.Section, EccZ=division_79, EccY=0)
shatter_38 = Shatter(Curve=list_item_34, Parameters=curve_closest_point_22.Parameter)
shatter_39 = Shatter(Curve=list_item_35, Parameters=curve_closest_point_23.Parameter)
shatter_40 = Shatter(Curve=list_item_36, Parameters=curve_closest_point_24.Parameter)
rebuild_curve_25 = RebuildCurve(Curve=shatter_37, Degree="2", Count=10, Tangents=False)
line_member_23 = LineMember(Curve=rebuild_curve_25, Material=library_material.Material, Section=assign_section_21, Mesh=line_mesh_3)
rebuild_curve_26 = RebuildCurve(Curve=shatter_38, Degree="2", Count=10, Tangents=False)
line_member_24 = LineMember(Curve=rebuild_curve_26, Material=library_material.Material, Section=assign_section_22, Mesh=line_mesh_3)
rebuild_curve_27 = RebuildCurve(Curve=shatter_39, Degree="2", Count=10, Tangents=False)
line_member_25 = LineMember(Curve=rebuild_curve_27, Material=library_material.Material, Section=assign_section_23, Mesh=line_mesh_3)
rebuild_curve_28 = RebuildCurve(Curve=shatter_40, Degree="2", Count=10, Tangents=False)
line_member_26 = LineMember(Curve=rebuild_curve_28, Material=library_material.Material, Section=assign_section_24, Mesh=line_mesh_3)
width_25 = Slider(20, range=0..100)
thickness_26 = Slider(2.5, range=0..10)
width_26 = Slider(20, range=0..100)
thickness_27 = Slider(2.5, range=0..10)
width_27 = Slider(20, range=0..100)
thickness_28 = Slider(2.5, range=0..10)
width_28 = Slider(20, range=0..100)
thickness_29 = Slider(2.5, range=0..10)
division_80 = Division(A=width_25, B="12")
curve_25 = Curve(move_2.Geometry)
division_81 = Division(A=thickness_26, B="12")
division_82 = Division(A=width_26, B="12")
curve_26 = Curve(move.Geometry)
division_83 = Division(A=thickness_27, B="12")
division_84 = Division(A=width_27, B="12")
curve_27 = Curve(move_5.Geometry)
division_85 = Division(A=thickness_28, B="12")
division_86 = Division(A=width_28, B="12")
curve_28 = Curve(move_3.Geometry)
division_87 = Division(A=thickness_29, B="12")
list_item_37 = ListItem(List=curve_25, Index="1", Wrap=True)
list_item_38 = ListItem(List=curve_26, Index="1", Wrap=True)
parametric_section_27 = ParametricSection(Name="G1_TF2", B=division_80, D=division_81, Stored_SectionSubType="Solid", Stored_SectionType="Rectangular")  # -> Section, Area
list_item_39 = ListItem(List=curve_27, Index="1", Wrap=True)
parametric_section_28 = ParametricSection(Name="G2_TF2", B=division_82, D=division_83, Stored_SectionSubType="Solid", Stored_SectionType="Rectangular")  # -> Section, Area
parametric_section_29 = ParametricSection(Name="G3_TF2", B=division_84, D=division_85, Stored_SectionSubType="Solid", Stored_SectionType="Rectangular")  # -> Section, Area
list_item_40 = ListItem(List=curve_28, Index="1", Wrap=True)
parametric_section_30 = ParametricSection(Name="G4_TF2", B=division_86, D=division_87, Stored_SectionSubType="Solid", Stored_SectionType="Rectangular")  # -> Section, Area
division_88 = Division(A=division_81, B="-2")
division_89 = Division(A=division_83, B="-2")
curve_closest_point_25 = CurveClosestPoint(Point=end_points_7.Start, Curve=list_item_37)  # -> Point, Parameter, Distance
division_90 = Division(A=division_85, B="-2")
curve_closest_point_26 = CurveClosestPoint(Point=end_points_7.Start, Curve=list_item_38)  # -> Point, Parameter, Distance
division_91 = Division(A=division_87, B="-2")
curve_closest_point_27 = CurveClosestPoint(Point=end_points_7.Start, Curve=list_item_39)  # -> Point, Parameter, Distance
assign_section_25 = AssignSection(Section=parametric_section_27.Section, EccZ=division_88, EccY=0)
curve_closest_point_28 = CurveClosestPoint(Point=end_points_7.Start, Curve=list_item_40)  # -> Point, Parameter, Distance
assign_section_26 = AssignSection(Section=parametric_section_28.Section, EccZ=division_89, EccY=0)
assign_section_27 = AssignSection(Section=parametric_section_29.Section, EccZ=division_90, EccY=0)
shatter_41 = Shatter(Curve=list_item_37, Parameters=curve_closest_point_25.Parameter)
assign_section_28 = AssignSection(Section=parametric_section_30.Section, EccZ=division_91, EccY=0)
shatter_42 = Shatter(Curve=list_item_38, Parameters=curve_closest_point_26.Parameter)
shatter_43 = Shatter(Curve=list_item_39, Parameters=curve_closest_point_27.Parameter)
shatter_44 = Shatter(Curve=list_item_40, Parameters=curve_closest_point_28.Parameter)
rebuild_curve_29 = RebuildCurve(Curve=shatter_41, Degree="2", Count=10, Tangents=False)
line_member_27 = LineMember(Curve=rebuild_curve_29, Material=library_material.Material, Section=assign_section_25, Mesh=line_mesh_3)
rebuild_curve_30 = RebuildCurve(Curve=shatter_42, Degree="2", Count=10, Tangents=False)
line_member_28 = LineMember(Curve=rebuild_curve_30, Material=library_material.Material, Section=assign_section_26, Mesh=line_mesh_3)
rebuild_curve_31 = RebuildCurve(Curve=shatter_43, Degree="2", Count=10, Tangents=False)
line_member_29 = LineMember(Curve=rebuild_curve_31, Material=library_material.Material, Section=assign_section_27, Mesh=line_mesh_3)
rebuild_curve_32 = RebuildCurve(Curve=shatter_44, Degree="2", Count=10, Tangents=False)
line_member_30 = LineMember(Curve=rebuild_curve_32, Material=library_material.Material, Section=assign_section_28, Mesh=line_mesh_3)
width_29 = Slider(18, range=0..100)
thickness_30 = Slider(1, range=0..10)
width_30 = Slider(18, range=0..100)
thickness_31 = Slider(1, range=0..10)
width_31 = Slider(18, range=0..100)
thickness_32 = Slider(1, range=0..10)
width_32 = Slider(18, range=0..100)
thickness_33 = Slider(1, range=0..10)
division_92 = Division(A=width_29, B="12")
curve_29 = Curve(move_2.Geometry)
division_93 = Division(A=thickness_30, B="12")
division_94 = Division(A=width_30, B="12")
curve_30 = Curve(move.Geometry)
division_95 = Division(A=thickness_31, B="12")
division_96 = Division(A=width_31, B="12")
curve_31 = Curve(move_5.Geometry)
division_97 = Division(A=thickness_32, B="12")
division_98 = Division(A=width_32, B="12")
curve_32 = Curve(move_3.Geometry)
division_99 = Division(A=thickness_33, B="12")
list_item_41 = ListItem(List=curve_29, Index="2", Wrap=True)
list_item_42 = ListItem(List=curve_30, Index="2", Wrap=True)
parametric_section_31 = ParametricSection(Name="G1_TF3", B=division_92, D=division_93, Stored_SectionSubType="Solid", Stored_SectionType="Rectangular")  # -> Section, Area
list_item_43 = ListItem(List=curve_31, Index="2", Wrap=True)
parametric_section_32 = ParametricSection(Name="G2_TF3", B=division_94, D=division_95, Stored_SectionSubType="Solid", Stored_SectionType="Rectangular")  # -> Section, Area
parametric_section_33 = ParametricSection(Name="G3_TF3", B=division_96, D=division_97, Stored_SectionSubType="Solid", Stored_SectionType="Rectangular")  # -> Section, Area
list_item_44 = ListItem(List=curve_32, Index="2", Wrap=True)
parametric_section_34 = ParametricSection(Name="G4_TF3", B=division_98, D=division_99, Stored_SectionSubType="Solid", Stored_SectionType="Rectangular")  # -> Section, Area
division_100 = Division(A=division_93, B="-2")
division_101 = Division(A=division_95, B="-2")
curve_closest_point_29 = CurveClosestPoint(Point=end_points_7.Start, Curve=list_item_41)  # -> Point, Parameter, Distance
division_102 = Division(A=division_97, B="-2")
curve_closest_point_30 = CurveClosestPoint(Point=end_points_7.Start, Curve=list_item_42)  # -> Point, Parameter, Distance
division_103 = Division(A=division_99, B="-2")
curve_closest_point_31 = CurveClosestPoint(Point=end_points_7.Start, Curve=list_item_43)  # -> Point, Parameter, Distance
assign_section_29 = AssignSection(Section=parametric_section_31.Section, EccZ=division_100, EccY=0)
curve_closest_point_32 = CurveClosestPoint(Point=end_points_7.Start, Curve=list_item_44)  # -> Point, Parameter, Distance
assign_section_30 = AssignSection(Section=parametric_section_32.Section, EccZ=division_101, EccY=0)
assign_section_31 = AssignSection(Section=parametric_section_33.Section, EccZ=division_102, EccY=0)
shatter_45 = Shatter(Curve=list_item_41, Parameters=curve_closest_point_29.Parameter)
assign_section_32 = AssignSection(Section=parametric_section_34.Section, EccZ=division_103, EccY=0)
shatter_46 = Shatter(Curve=list_item_42, Parameters=curve_closest_point_30.Parameter)
shatter_47 = Shatter(Curve=list_item_43, Parameters=curve_closest_point_31.Parameter)
shatter_48 = Shatter(Curve=list_item_44, Parameters=curve_closest_point_32.Parameter)
rebuild_curve_33 = RebuildCurve(Curve=shatter_45, Degree="2", Count=10, Tangents=False)
line_member_31 = LineMember(Curve=rebuild_curve_33, Material=library_material.Material, Section=assign_section_29, Mesh=line_mesh_3)
rebuild_curve_34 = RebuildCurve(Curve=shatter_46, Degree="2", Count=10, Tangents=False)
line_member_32 = LineMember(Curve=rebuild_curve_34, Material=library_material.Material, Section=assign_section_30, Mesh=line_mesh_3)
rebuild_curve_35 = RebuildCurve(Curve=shatter_47, Degree="2", Count=10, Tangents=False)
line_member_33 = LineMember(Curve=rebuild_curve_35, Material=library_material.Material, Section=assign_section_31, Mesh=line_mesh_3)
rebuild_curve_36 = RebuildCurve(Curve=shatter_48, Degree="2", Count=10, Tangents=False)
line_member_34 = LineMember(Curve=rebuild_curve_36, Material=library_material.Material, Section=assign_section_32, Mesh=line_mesh_3)
width_33 = Slider(20, range=0..100)
thickness_34 = Slider(2.5, range=0..10)
width_34 = Slider(20, range=0..100)
thickness_35 = Slider(2.5, range=0..10)
width_35 = Slider(20, range=0..100)
thickness_36 = Slider(2.5, range=0..10)
width_36 = Slider(20, range=0..100)
thickness_37 = Slider(2.5, range=0..10)
division_104 = Division(A=width_33, B="12")
curve_33 = Curve(move_2.Geometry)
division_105 = Division(A=thickness_34, B="12")
division_106 = Division(A=width_34, B="12")
curve_34 = Curve(move.Geometry)
division_107 = Division(A=thickness_35, B="12")
division_108 = Division(A=width_35, B="12")
curve_35 = Curve(move_5.Geometry)
division_109 = Division(A=thickness_36, B="12")
division_110 = Division(A=width_36, B="12")
curve_36 = Curve(move_3.Geometry)
division_111 = Division(A=thickness_37, B="12")
list_item_45 = ListItem(List=curve_33, Index="3", Wrap=True)
list_item_46 = ListItem(List=curve_34, Index="3", Wrap=True)
parametric_section_35 = ParametricSection(Name="G1_TF4", B=division_104, D=division_105, Stored_SectionSubType="Solid", Stored_SectionType="Rectangular")  # -> Section, Area
list_item_47 = ListItem(List=curve_35, Index="3", Wrap=True)
parametric_section_36 = ParametricSection(Name="G2_TF4", B=division_106, D=division_107, Stored_SectionSubType="Solid", Stored_SectionType="Rectangular")  # -> Section, Area
parametric_section_37 = ParametricSection(Name="G3_TF4", B=division_108, D=division_109, Stored_SectionSubType="Solid", Stored_SectionType="Rectangular")  # -> Section, Area
list_item_48 = ListItem(List=curve_36, Index="3", Wrap=True)
parametric_section_38 = ParametricSection(Name="G4_TF4", B=division_110, D=division_111, Stored_SectionSubType="Solid", Stored_SectionType="Rectangular")  # -> Section, Area
division_112 = Division(A=division_105, B="-2")
division_113 = Division(A=division_107, B="-2")
curve_closest_point_33 = CurveClosestPoint(Point=end_points_7.Start, Curve=list_item_45)  # -> Point, Parameter, Distance
division_114 = Division(A=division_109, B="-2")
curve_closest_point_34 = CurveClosestPoint(Point=end_points_7.Start, Curve=list_item_46)  # -> Point, Parameter, Distance
division_115 = Division(A=division_111, B="-2")
curve_closest_point_35 = CurveClosestPoint(Point=end_points_7.Start, Curve=list_item_47)  # -> Point, Parameter, Distance
assign_section_33 = AssignSection(Section=parametric_section_35.Section, EccZ=division_112, EccY=0)
curve_closest_point_36 = CurveClosestPoint(Point=end_points_7.Start, Curve=list_item_48)  # -> Point, Parameter, Distance
assign_section_34 = AssignSection(Section=parametric_section_36.Section, EccZ=division_113, EccY=0)
assign_section_35 = AssignSection(Section=parametric_section_37.Section, EccZ=division_114, EccY=0)
shatter_49 = Shatter(Curve=list_item_45, Parameters=curve_closest_point_33.Parameter)
assign_section_36 = AssignSection(Section=parametric_section_38.Section, EccZ=division_115, EccY=0)
shatter_50 = Shatter(Curve=list_item_46, Parameters=curve_closest_point_34.Parameter)
shatter_51 = Shatter(Curve=list_item_47, Parameters=curve_closest_point_35.Parameter)
shatter_52 = Shatter(Curve=list_item_48, Parameters=curve_closest_point_36.Parameter)
rebuild_curve_37 = RebuildCurve(Curve=shatter_49, Degree="2", Count=10, Tangents=False)
line_member_35 = LineMember(Curve=rebuild_curve_37, Material=library_material.Material, Section=assign_section_33, Mesh=line_mesh_3)
rebuild_curve_38 = RebuildCurve(Curve=shatter_50, Degree="2", Count=10, Tangents=False)
line_member_36 = LineMember(Curve=rebuild_curve_38, Material=library_material.Material, Section=assign_section_34, Mesh=line_mesh_3)
rebuild_curve_39 = RebuildCurve(Curve=shatter_51, Degree="2", Count=10, Tangents=False)
line_member_37 = LineMember(Curve=rebuild_curve_39, Material=library_material.Material, Section=assign_section_35, Mesh=line_mesh_3)
rebuild_curve_40 = RebuildCurve(Curve=shatter_52, Degree="2", Count=10, Tangents=False)
line_member_38 = LineMember(Curve=rebuild_curve_40, Material=library_material.Material, Section=assign_section_36, Mesh=line_mesh_3)
width_37 = Slider(18, range=0..100)
thickness_38 = Slider(1, range=0..10)
width_38 = Slider(18, range=0..100)
thickness_39 = Slider(1, range=0..10)
width_39 = Slider(18, range=0..100)
thickness_40 = Slider(1, range=0..10)
width_40 = Slider(18, range=0..100)
thickness_41 = Slider(1, range=0..10)
division_116 = Division(A=width_37, B="12")
curve_37 = Curve(move_2.Geometry)
division_117 = Division(A=thickness_38, B="12")
division_118 = Division(A=width_38, B="12")
curve_38 = Curve(move.Geometry)
division_119 = Division(A=thickness_39, B="12")
division_120 = Division(A=width_39, B="12")
curve_39 = Curve(move_5.Geometry)
division_121 = Division(A=thickness_40, B="12")
division_122 = Division(A=width_40, B="12")
curve_40 = Curve(move_3.Geometry)
division_123 = Division(A=thickness_41, B="12")
list_item_49 = ListItem(List=curve_37, Index="4", Wrap=True)
list_item_50 = ListItem(List=curve_38, Index="4", Wrap=True)
parametric_section_39 = ParametricSection(Name="G1_TF5", B=division_116, D=division_117, Stored_SectionSubType="Solid", Stored_SectionType="Rectangular")  # -> Section, Area
list_item_51 = ListItem(List=curve_39, Index="4", Wrap=True)
parametric_section_40 = ParametricSection(Name="G2_TF5", B=division_118, D=division_119, Stored_SectionSubType="Solid", Stored_SectionType="Rectangular")  # -> Section, Area
parametric_section_41 = ParametricSection(Name="G3_TF5", B=division_120, D=division_121, Stored_SectionSubType="Solid", Stored_SectionType="Rectangular")  # -> Section, Area
list_item_52 = ListItem(List=curve_40, Index="4", Wrap=True)
parametric_section_42 = ParametricSection(Name="G4_TF5", B=division_122, D=division_123, Stored_SectionSubType="Solid", Stored_SectionType="Rectangular")  # -> Section, Area
division_124 = Division(A=division_117, B="-2")
division_125 = Division(A=division_119, B="-2")
curve_closest_point_37 = CurveClosestPoint(Point=end_points_7.Start, Curve=list_item_49)  # -> Point, Parameter, Distance
division_126 = Division(A=division_121, B="-2")
curve_closest_point_38 = CurveClosestPoint(Point=end_points_7.Start, Curve=list_item_50)  # -> Point, Parameter, Distance
division_127 = Division(A=division_123, B="-2")
curve_closest_point_39 = CurveClosestPoint(Point=end_points_7.Start, Curve=list_item_51)  # -> Point, Parameter, Distance
assign_section_37 = AssignSection(Section=parametric_section_39.Section, EccZ=division_124, EccY=0)
curve_closest_point_40 = CurveClosestPoint(Point=end_points_7.Start, Curve=list_item_52)  # -> Point, Parameter, Distance
assign_section_38 = AssignSection(Section=parametric_section_40.Section, EccZ=division_125, EccY=0)
assign_section_39 = AssignSection(Section=parametric_section_41.Section, EccZ=division_126, EccY=0)
shatter_53 = Shatter(Curve=list_item_49, Parameters=curve_closest_point_37.Parameter)
assign_section_40 = AssignSection(Section=parametric_section_42.Section, EccZ=division_127, EccY=0)
shatter_54 = Shatter(Curve=list_item_50, Parameters=curve_closest_point_38.Parameter)
shatter_55 = Shatter(Curve=list_item_51, Parameters=curve_closest_point_39.Parameter)
shatter_56 = Shatter(Curve=list_item_52, Parameters=curve_closest_point_40.Parameter)
rebuild_curve_41 = RebuildCurve(Curve=shatter_53, Degree="2", Count=10, Tangents=False)
line_member_39 = LineMember(Curve=rebuild_curve_41, Material=library_material.Material, Section=assign_section_37, Mesh=line_mesh_3)
rebuild_curve_42 = RebuildCurve(Curve=shatter_54, Degree="2", Count=10, Tangents=False)
line_member_40 = LineMember(Curve=rebuild_curve_42, Material=library_material.Material, Section=assign_section_38, Mesh=line_mesh_3)
rebuild_curve_43 = RebuildCurve(Curve=shatter_55, Degree="2", Count=10, Tangents=False)
line_member_41 = LineMember(Curve=rebuild_curve_43, Material=library_material.Material, Section=assign_section_39, Mesh=line_mesh_3)
rebuild_curve_44 = RebuildCurve(Curve=shatter_56, Degree="2", Count=10, Tangents=False)
line_member_42 = LineMember(Curve=rebuild_curve_44, Material=library_material.Material, Section=assign_section_40, Mesh=line_mesh_3)

lusas_model = LUSASModel(
    Member=[surface_member, line_member, line_member_3, line_member_7, line_member_11, line_member_15, line_member_19, line_member_4, line_member_5, line_member_6, line_member_8, line_member_9, line_member_10, line_member_12, line_member_13, line_member_14, line_member_16, line_member_17, line_member_18, line_member_20, line_member_21, line_member_22, line_member_23, line_member_27, line_member_31, line_member_35, line_member_39, line_member_24, line_member_28, line_member_32, line_member_36, line_member_40, line_member_25, line_member_29, line_member_33, line_member_37, line_member_41, line_member_26, line_member_30, line_member_34, line_member_38, line_member_42, line_member_2],
    Analyses=analysis,
    Assignments=[assign_point_support_2, assign_point_support],
    Stored_Units="kip,ft,kslug,s,C")
live_link = LiveLink(
    Model=lusas_model,
    Append=panel,
    Run=Toggle(False),
    Stored_LastBrowsedDirectory="C:\Users\paulbd\Desktop\GRASSHOPPER\250331",
    Stored_LastExportFilename="CurvedPlateGirderBridge.mdl",
    Stored_LinkMode=0)
model_preview = ModelPreview(
    Model=lusas_model,
    Stored_Analysis="A1",
    Stored_Loadcase="LC1",
    Stored_PreviewLoads=True,
    Stored_PreviewSections=True,
    Stored_PreviewSupports=True,
    Stored_Scale=1)
