# Grasshopper definition 03_LUSAS_GH_CurvedTubGirder.gh (Grasshopper 1.0.8)
# plug-ins: LUSAS_Grasshopper

# ----
# Radius of Curvature
# Bottom Flange Width
# Number of Subdivisions
# Top Width
# Top Flange Width
# Web Depth
radius_of_curvature = Slider(500, range=0..1000)
bottom_flange_width = Slider(85, range=0..100)
number_of_subdivisions = Slider(8, range=0..20)
top_width = Slider(140, range=0..200)
top_flange_width = Slider(24, range=0..50)
web_depth = Slider(85, range=0..100)

pi = Pi(Factor=1)
division = Division(A=bottom_flange_width, B="2")
multiplication = Multiplication(A=radius_of_curvature, B="12")
division_2 = Division(A=pi, B="10")
addition = Addition(A=multiplication, B=division)
division_3 = Division(A=top_width, B="2")
negative = Negative(Value=division)
arc = Arc(Plane=PlaneXY(0, 0, 0), Radius=multiplication, Angle=division_2)  # -> Arc, Length
addition_2 = Addition(A=multiplication, B=division_3)
negative_2 = Negative(Value=division_3)
addition_3 = Addition(A=multiplication, B=negative)
arc_2 = Arc(Plane=PlaneXY(0, 0, 0), Radius=addition, Angle=division_2)  # -> Arc, Length
arc_3 = Arc(Plane=PlaneXY(0, 0, 0), Radius=addition_3, Angle=division_2)  # -> Arc, Length
addition_4 = Addition(A=multiplication, B=negative_2)
end_points = EndPoints(Curve=arc_2.Arc)  # -> Start, End
arc_4 = Arc(Plane=PlaneXY(0, 0, 0), Radius=addition_4, Angle=division_2)  # -> Arc, Length
rebuild_curve = RebuildCurve(Curve=arc_3.Arc, Degree="2", Count=10, Tangents=False)
end_points_2 = EndPoints(Curve=arc_3.Arc)  # -> Start, End
arc_5 = Arc(Plane=PlaneXY(0, 0, 0), Radius=addition_2, Angle=division_2)  # -> Arc, Length
vector_xyz = VectorXYZ(XComponent=0, YComponent=0, ZComponent=web_depth)  # -> Vector, Length
divide_curve = DivideCurve(Curve=rebuild_curve, Count=number_of_subdivisions, Kinks=False)  # -> Points, Tangents, Parameters
rebuild_curve_2 = RebuildCurve(Curve=arc_2.Arc, Degree="2", Count=10, Tangents=False)
rebuild_curve_3 = RebuildCurve(Curve=arc.Arc, Degree="2", Count=10, Tangents=False)
shatter = Shatter(Curve=rebuild_curve, Parameters=divide_curve.Parameters)
end_points_3 = EndPoints(Curve=shatter)  # -> Start, End
list_item = ListItem(List=end_points_3.End, Index="-1", Wrap=True)
move = Move(Geometry=arc_5.Arc, Motion=vector_xyz.Vector)  # -> Geometry, Transform
move_2 = Move(Geometry=arc_4.Arc, Motion=vector_xyz.Vector)  # -> Geometry, Transform
divide_curve_2 = DivideCurve(Curve=rebuild_curve_2, Count=number_of_subdivisions, Kinks=False)  # -> Points, Tangents, Parameters
divide_curve_3 = DivideCurve(Curve=rebuild_curve_2, Count=number_of_subdivisions, Kinks=False)  # -> Points, Tangents, Parameters
divide_curve_4 = DivideCurve(Curve=rebuild_curve_3, Count=number_of_subdivisions, Kinks=False)  # -> Points, Tangents, Parameters
rebuild_curve_4 = RebuildCurve(Curve=move.Geometry, Degree="2", Count=10, Tangents=False)
rebuild_curve_5 = RebuildCurve(Curve=move_2.Geometry, Degree="2", Count=10, Tangents=False)
shatter_2 = Shatter(Curve=rebuild_curve_3, Parameters=divide_curve_4.Parameters)
shatter_3 = Shatter(Curve=rebuild_curve_2, Parameters=divide_curve_2.Parameters)
end_points_4 = EndPoints(Curve=shatter_3)  # -> Start, End
list_item_2 = ListItem(List=end_points_4.End, Index="-1", Wrap=True)
shatter_4 = Shatter(Curve=rebuild_curve_2, Parameters=divide_curve_3.Parameters)
divide_curve_5 = DivideCurve(Curve=rebuild_curve_4, Count=number_of_subdivisions, Kinks=False)  # -> Points, Tangents, Parameters
divide_curve_6 = DivideCurve(Curve=rebuild_curve_5, Count=number_of_subdivisions, Kinks=False)  # -> Points, Tangents, Parameters
shatter_5 = Shatter(Curve=rebuild_curve_4, Parameters=divide_curve_5.Parameters)
end_points_5 = EndPoints(Curve=shatter_5)  # -> Start, End
list_item_3 = ListItem(List=end_points_5.End, Index="-1", Wrap=True)
line = Line(StartPoint=end_points_5.Start, EndPoint=end_points_4.Start)
line_2 = Line(StartPoint=list_item_3, EndPoint=list_item_2)
line_3 = Line(StartPoint=end_points_3.Start, EndPoint=end_points_5.Start)
line_4 = Line(StartPoint=list_item, EndPoint=list_item_3)
shatter_6 = Shatter(Curve=rebuild_curve_5, Parameters=divide_curve_6.Parameters)
end_points_6 = EndPoints(Curve=shatter_6)  # -> Start, End
line_5 = Line(StartPoint=end_points_3.Start, EndPoint=end_points_6.Start)
list_item_4 = ListItem(List=end_points_6.End, Index="-1", Wrap=True)
line_6 = Line(StartPoint=list_item, EndPoint=list_item_4)
line_7 = Line(StartPoint=end_points_6.Start, EndPoint=end_points_4.Start)
line_8 = Line(StartPoint=list_item_4, EndPoint=list_item_3)
line_9 = Line(StartPoint=list_item_4, EndPoint=list_item_2)
line_10 = Line(StartPoint=end_points_6.Start, EndPoint=end_points_5.Start)
line_11 = Line([line, line_5, line_2, line_6])
ruled_surface = RuledSurface(CurveA=shatter_2, CurveB=shatter_3)
ruled_surface_2 = RuledSurface(CurveA=shatter_2, CurveB=shatter)
ruled_surface_3 = RuledSurface(CurveA=shatter_4, CurveB=shatter_5)
ruled_surface_4 = RuledSurface(CurveA=shatter, CurveB=shatter_6)
surface = Surface([ruled_surface, ruled_surface_2])
division_4 = Division(A=top_flange_width, B="2")
offset_curve = OffsetCurve(Curve=shatter_5, Distance=division_4, Corners=1)  # -> flatten(Curve)
negative_3 = Negative(Value=division_4)
offset_curve_2 = OffsetCurve(Curve=shatter_6, Distance=negative_3, Corners=1)  # -> flatten(Curve)
offset_curve_3 = OffsetCurve(Curve=shatter_6, Distance=division_4, Corners=1)  # -> flatten(Curve)
offset_curve_4 = OffsetCurve(Curve=shatter_5, Distance=negative_3, Corners=1)  # -> flatten(Curve)
ruled_surface_5 = RuledSurface(CurveA=shatter_6, CurveB=offset_curve_2)  # -> flatten(Surface)
ruled_surface_6 = RuledSurface(CurveA=shatter_6, CurveB=offset_curve_3)  # -> flatten(Surface)
ruled_surface_7 = RuledSurface(CurveA=shatter_5, CurveB=offset_curve)  # -> flatten(Surface)
ruled_surface_8 = RuledSurface(CurveA=shatter_5, CurveB=offset_curve_4)  # -> flatten(Surface)
surface_2 = Surface([ruled_surface_5, ruled_surface_6, ruled_surface_7, ruled_surface_8])

bottom_flange_thickness = Slider(1.5, range=0..3)
top_flange_thickness = Slider(2.5, range=0..5)
web_thickness = Slider(1, range=0..2)
width = Slider(12, range=0..40)
thickness = Slider(0.75, range=0..2)
number_slider = Slider(5, range=0..10)
number_slider_2 = Slider(0.5, range=0..1)
surface_section = SurfaceSection(Name="Bottom flange", Thickness=bottom_flange_thickness)
surface_section_2 = SurfaceSection(Name="TopFlange", Thickness=top_flange_thickness)
surface_section_3 = SurfaceSection(Name="Web", Thickness=web_thickness)
parametric_section = ParametricSection(Name="ConnectingPlates", B=thickness, D=width, Stored_SectionSubType="Solid", Stored_SectionType="Rectangular")  # -> Section, Area
parametric_section_2 = ParametricSection(
    Name="Cross-Frames",
    B=number_slider,
    D=number_slider,
    Tf=number_slider_2,
    Tw=number_slider_2,
    Stored_SectionSubType="Standard",
    Stored_SectionType="L")  # -> Section, Area
surface_3 = Surface([ruled_surface_3, ruled_surface_4])
line_12 = Line([line_3, line_4, line_7, line_9, line_10, line_8])
library_material = LibraryMaterial(
    Name="Steel",
    Stored_Material_Grade="Ungraded",
    Stored_Material_Region="USA",
    Stored_Material_Standard="AASHTO LRFD 4th-9th",
    Stored_Material_Type="Steel - Structural")  # -> Material, Density
mesh_size = Slider(24, range=0..50)
line_mesh = LineMesh(Name="ThickBeam", Length=mesh_size, Stored_MeshElementOrder="Quadratic", Stored_MeshType="ThickBeam")
line_member = LineMember(Curve=line_11, Material=library_material.Material, Section=parametric_section.Section, Mesh=line_mesh)
line_member_2 = LineMember(Curve=line_12, Material=library_material.Material, Section=parametric_section_2.Section, Mesh=line_mesh)
load = Slider(0.05, range=0..0.1)
support = Support(Name="XYZ", TransSprings=Vector(0, 0, 0), RotSprings=Vector(0, 0, 0))
support_2 = Support(Name="XZ", TransSprings=Vector(0, 0, 0), RotSprings=Vector(0, 0, 0))
support_3 = Support(Name="Z", TransSprings=Vector(0, 0, 0), RotSprings=Vector(0, 0, 0))
mesh_size_2 = Slider(24, range=0..100)
vector_xyz_2 = VectorXYZ(XComponent=0, YComponent=0, ZComponent=expr("-x", load))  # -> Vector, Length
assign_point_support = AssignPointSupport(Point=end_points_2.End, Support=support_2, Analysis="A1")
assign_point_support_2 = AssignPointSupport(Point=end_points_2.Start, Support=support, Analysis="A1")
assign_point_support_3 = AssignPointSupport(Point=[end_points.Start, end_points.End], Support=support_3, Analysis="A1")
analysis = Analysis(Name="A1", Loadcases="LC1", Stored_IsBaseAnalysis=True)
surface_mesh = SurfaceMesh(
    Name="ThickShell",
    Size=mesh_size_2,
    Stored_MeshElementOrder="Quadratic",
    Stored_MeshShape="Quadrilateral",
    Stored_MeshType="ThickShell",
    Stored_Regularity=1)
surface_member = SurfaceMember(Brep=surface, Material=library_material.Material, Section=surface_section, Mesh=surface_mesh)
surface_member_2 = SurfaceMember(Brep=surface_3, Material=library_material.Material, Section=surface_section_3, Mesh=surface_mesh)
surface_member_3 = SurfaceMember(Brep=surface_2, Material=library_material.Material, Section=surface_section_2, Mesh=surface_mesh)
load_2 = Load(Name="Line Load", Force=vector_xyz_2.Vector, Moment=Vector(0, 0, 0))
curve = Curve([shatter_5, shatter_6])
assign_line_load = AssignLineLoad(Curve=curve, Load=load_2, Loadcase="LC1")
lusas_model = LUSASModel(
    Member=[surface_member, surface_member_3, surface_member_2, line_member, line_member_2],
    Analyses=analysis,
    Assignments=[assign_point_support_3, assign_point_support_2, assign_point_support, assign_line_load],
    Stored_Units="kip,in,kslinch,s,C")
panel = Panel("""redim setOrigin(2)
setOrigin(0) = 0.0
setOrigin(1) = 0.0
setOrigin(2) = 0.0
redim matrixCol0(2)
matrixCol0(0) = 1.0
matrixCol0(1) = 0.0
matrixCol0(2) = 0.0
redim matrixCol1(2)
matrixCol1(0) = 0.0
matrixCol1(1) = 1.0
matrixCol1(2) = 0.0
redim matrixCol2(2)
matrixCol2(0) = 0.0
matrixCol2(1) = 0.0
matrixCol2(2) = 1.0
set attr = database.createLocalCylindricalAttr("LCrd1", setOrigin, matrixCol0, matrixCol1, matrixCol2)
call attr.setAxesType("Z_Cylindrical")
redim FEAtemp1(2)
FEAtemp1(0) = 0.0
FEAtemp1(1) = 0.0
FEAtemp1(2) = 1.0
call attr.setCylindricalDefnData("z", 0.0, FEAtemp1)
erase FEAtemp1
set attr = nothing
set attr = database.getAttribute("Structural Support", "Z")
call assignment.setIgnoreAll()
call assignment.setLoadset("LC1")
call selection.add(attr, assignment)
set attr = nothing
'selection now contains:;P2;P34
set attr = database.getAttribute("Structural Support", "XYZ")
call assignment.setIgnoreAll()
call assignment.setLoadset("LC1")
call selection.add(attr, assignment)
set attr = nothing
'selection now contains:;P2;P34;P17
set attr = database.getAttribute("Structural Support", "XZ")
call assignment.setIgnoreAll()
call assignment.setLoadset("LC1")
call selection.add(attr, assignment)
set attr = nothing
'selection now contains:;P2;P34;P17;P35
set attr = database.getAttribute("Line Geometric", "ConnectingPlates")
call assignment.setIgnoreAll()
call assignment.setLoadset("LC1")
call assignment.setAnalysis("A1")
call selection.add(attr, assignment)
set attr = nothing
'selection now contains:;P2;P34;P17;P35;L1;L2;L3;L4;L5;L6;L7;L8;L9;L10;L11;L12;L13;L14;L15;L16;L17;L18
call assignment.setAllDefaults()
call assignment.setLoadset("LC1")
call database.getAttribute("Local Coordinates", "LCrd1").assignTo(selection, assignment)
call database.updateMesh()
call selection.remove("All")""")
model_preview = ModelPreview(
    Model=lusas_model,
    Stored_Analysis="A1",
    Stored_Loadcase="LC1",
    Stored_PreviewLoads=True,
    Stored_PreviewSections=True,
    Stored_PreviewSupports=True,
    Stored_Scale=1)
live_link = LiveLink(
    Model=lusas_model,
    Append=panel,
    Run=Toggle(False),
    Stored_LastBrowsedDirectory="C:\Users\paulbd\Desktop\GRASSHOPPER\250331",
    Stored_LastExportFilename="CurvedTubGirder.mdl",
    Stored_LinkMode=0)
