# Grasshopper definition 04_LUSAS_GH_GeodesicRoof.gh (Grasshopper 1.0.8)
# plug-ins: LunchBox, LUSAS_Grasshopper

# ----
# Radius
# Height
# Number of Rings
# Member Length
radius = Slider(30, range=0..100)
height = Slider(8, range=0..25)
rings = Slider(7, range=0..12)
member_length = Slider(4, range=1..10)

construct_point = ConstructPoint(XCoordinate=0, YCoordinate=0, ZCoordinate=0)
subtraction = Subtraction(A=radius, B=height)
unit_z = UnitZ(Factor=subtraction)
circle = Circle(Plane=construct_point, Radius=radius)
sphere = Sphere(Base=construct_point, Radius=radius)
xz_plane = XZPlane(Origin=Point(0, 0, 0))
move = Move(Geometry=circle, Motion=unit_z)  # -> Geometry, Transform
rotate = Rotate(Geometry=circle, Angle=1.570796327, Plane=xz_plane)  # -> Geometry, Transform
split_brep = SplitBrep(Brep=sphere, Cutter=move.Geometry)
list_item = ListItem(List=split_brep, Index=0, Wrap=True)
split_with_brep = SplitWithBrep(Curve=rotate.Geometry, Brep=list_item)  # -> Curve, Points
brep_edges = BrepEdges(Brep=list_item)  # -> Naked, Interior, NonManifold
list_item_2 = ListItem(List=reverse(split_with_brep.Curve), Index=0, Wrap=True)
divide_curve = DivideCurve(Curve=list_item_2, Count=2, Kinks=False)  # -> Points, Tangents, Parameters
shatter = Shatter(Curve=list_item_2, Parameters=divide_curve.Parameters)
list_item_3 = ListItem(List=divide_curve.Points, Index=1, Wrap=True)
length = Length(Curve=shatter)
list_item_4 = ListItem(List=length, Index=0, Wrap=True)
division = Division(A=list_item_4, B=rings)
subtraction_2 = Subtraction(A=rings, B="1")
curve = Curve(brep_edges.Naked)
series = Series(Start=division, Step=division, Count=subtraction_2)
offset_on_srf = OffsetOnSrf(Curve=curve, Distance=series, Surface=list_item)  # -> flatten(Curve)
curve_2 = Curve(flatten([curve, offset_on_srf]))
length_2 = Length(Curve=curve_2)
division_2 = Division(A=length_2, B=member_length)
round = Round(Number=division_2)  # -> Nearest, Floor, Ceiling
divide_curve_2 = DivideCurve(Curve=curve_2, Count=round.Nearest, Kinks=False)  # -> flatten(Points), Tangents, Parameters
point = Point(flatten([divide_curve_2.Points, list_item_3]))
delaunay_mesh = DelaunayMesh(Points=point, Plane=PlaneXY(0, 0, 0))
mesh_to_nurbs = MeshToNurbs(Mesh=delaunay_mesh)  # -> QuadrangularSurfaces, TriangularSurfaces
mesh_edges = MeshEdges(Mesh=delaunay_mesh)  # -> NakedEdges, InteriorEdges, NonManifoldEdges
line = Line(mesh_edges.NakedEdges)
line_2 = Line(mesh_edges.InteriorEdges)

parametric_section = ParametricSection(
    Name="InteriorChords",
    B=Slider(0.15, range=0..0.5),
    D=Slider(0.6, range=0..1),
    T=Slider(0.01, range=0..0.025),
    Stored_SectionSubType="Hollow",
    Stored_SectionType="Rectangular")  # -> Section, Area
surface_mesh = SurfaceMesh(
    Name="ThickShell",
    Size=Slider(1, range=1..4),
    Stored_MeshElementOrder="Linear",
    Stored_MeshShape="Quadrilateral",
    Stored_MeshType="ThickShell",
    Stored_Regularity=0)
parametric_section_2 = ParametricSection(
    Name="PerimeterChords",
    B=Slider(0.15, range=0..0.5),
    D=Slider(0.6, range=0..1),
    T=Slider(0.01, range=0..0.025),
    Stored_SectionSubType="Hollow",
    Stored_SectionType="Rectangular")  # -> Section, Area
surface_section = SurfaceSection(Name="Shell", Thickness=Slider(0.005, range=0.001..0.02))
library_material = LibraryMaterial(
    Name="Aluminum",
    Stored_Material_Grade="Ungraded",
    Stored_Material_Region="(None)",
    Stored_Material_Standard="(None)",
    Stored_Material_Type="Aluminium")  # -> Material, Density
surface_member = SurfaceMember(Brep=mesh_to_nurbs.TriangularSurfaces, Material=library_material.Material, Section=surface_section, Mesh=surface_mesh)
line_mesh = LineMesh(Name="ThickBeam", Divisions=Slider(1, range=1..5), Stored_MeshElementOrder="Linear", Stored_MeshType="ThickBeam")
line_member = LineMember(Curve=line_2, Material=library_material.Material, Section=parametric_section.Section, Mesh=line_mesh)
line_member_2 = LineMember(Curve=line, Material=library_material.Material, Section=parametric_section_2.Section, Mesh=line_mesh)
gravity = Gravity(Factor=1, Loadcases="LC1")
support = Support(Name="Pin", TransSprings=Vector(0, 0, 0), RotSprings=Vector(0, 0, 0))
analysis = Analysis(Name="A1", Loadcases="LC1", Gravity=gravity, Stored_IsBaseAnalysis=True)
assign_line_support = AssignLineSupport(Curve=line, Support=support, Analysis="A1")
lusas_model = LUSASModel(
    Member=[line_member, line_member_2, surface_member],
    Analyses=analysis,
    Assignments=assign_line_support,
    Stored_Units="N,m,kg,s,C")
panel = Panel("""redim setOrigin(2)
setOrigin(0) = 0.0
setOrigin(1) = 0.0
setOrigin(2) = 0.0
redim matrixCol0(2)
matrixCol0(0) = 1.0
matrixCol0(1) = 0.0
matrixCol0(2) = 0.0
redim matrixCol1(2)
matrixCol1(0) = 0.0
matrixCol1(1) = 1.0
matrixCol1(2) = 0.0
redim matrixCol2(2)
matrixCol2(0) = 0.0
matrixCol2(1) = 0.0
matrixCol2(2) = 1.0
set attr = database.createLocalCylindricalAttr("LCrd1", setOrigin, matrixCol0, matrixCol1, matrixCol2)
call attr.setAxesType("Z_Cylindrical")
redim FEAtemp1(2)
FEAtemp1(0) = 0.0
FEAtemp1(1) = 0.0
FEAtemp1(2) = 1.0
call attr.setCylindricalDefnData("z", 0.0, FEAtemp1)
erase FEAtemp1
set attr = nothing
set attr = database.getAttribute("Structural Support", "Pin")
call assignment.setIgnoreAll()
call assignment.setLoadset("LC1")
call selection.add(attr, assignment)
set attr = nothing
'selection now contains:;L318;L319;L320;L321;L322;L323;L324;L325;L326;L327;L328;L329;L330;L331;L332;L333;L334;L335;
'L336;L337;L338;L339;L340;L341;L342;L343;L344;L345;L346;L347;L348;L349;L350;L351;L352
call assignment.setAllDefaults()
call assignment.setLoadset("LC1")
call database.getAttribute("Local Coordinates", "LCrd1").assignTo(selection, assignment)
call database.updateMesh()
call selection.remove("All")""")
model_preview = ModelPreview(
    Model=lusas_model,
    Stored_Analysis="A1",
    Stored_Loadcase="LC1",
    Stored_PreviewLoads=True,
    Stored_PreviewSections=True,
    Stored_PreviewSupports=True,
    Stored_Scale=1)
live_link = LiveLink(
    Model=lusas_model,
    Append=panel,
    Run=Toggle(False),
    Stored_LastBrowsedDirectory="C:\Users\paulbd\Desktop\GRASSHOPPER\250331",
    Stored_LastExportFilename="GeodesicRoof.mdl",
    Stored_LinkMode=0)
