# Grasshopper definition 05_LUSAS_GH_MobiusStrip.gh (Grasshopper 1.0.8)
# plug-ins: Pufferfish, LunchBox, LUSAS_Grasshopper

# ----
# Mobius Strip Parameters
# Number of Subdivisions
number_slider = Slider(0.1, range=0..1)
number_slider_2 = Slider(2, range=1..6)
number_slider_3 = Slider(8, range=1..10)

division = Division(A="1", B=number_slider_3)
addition = Addition(A=number_slider_3, B="1")
addition_2 = Addition(A=number_slider_2, B="1")
division_2 = Division(A="1", B=number_slider_2)
mobius_surface = MobiusSurface(
    UDivisions=100,
    VDivisions=100,
    RParameter=4,
    TParameter=Slider(0.5, range=0..3),
    Scale=number_slider,
    Domain1=Domain(-3.141592654, 3.141592654),
    Domain2=Domain(-1, 1))
series = Series(Start=0, Step=division_2, Count=addition_2)
series_2 = Series(Start=0, Step=division, Count=addition)
parameter_subdivide_surface = ParameterSubdivideSurface(Surface=mobius_surface, ParametersU=series_2, ParametersV=series)
brep_edges = BrepEdges(Brep=parameter_subdivide_surface)  # -> Naked, Interior, NonManifold
end_points = EndPoints(Curve=brep_edges.Naked)  # -> Start, End
deconstruct = Deconstruct(Point=end_points.Start)  # -> XComponent, YComponent, ZComponent
deconstruct_2 = Deconstruct(Point=end_points.End)  # -> XComponent, YComponent, ZComponent
absolute = Absolute(Value=deconstruct.YComponent)
absolute_2 = Absolute(Value=deconstruct_2.YComponent)
smaller_than = SmallerThan(FirstNumber=absolute, SecondNumber="0.0001")  # -> SmallerThan, OrEqualTo
smaller_than_2 = SmallerThan(FirstNumber=absolute_2, SecondNumber="0.0001")  # -> SmallerThan, OrEqualTo
gate_and = GateAnd(A=smaller_than.SmallerThan, B=smaller_than_2.SmallerThan)
cull_pattern = CullPattern(List=brep_edges.Naked, CullPattern=gate_and)
unit_z = UnitZ(Factor=1)
cross_product = CrossProduct(VectorA=cull_pattern, VectorB=unit_z, Unitize=False)  # -> Vector, Length
smaller_than_3 = SmallerThan(FirstNumber=cross_product.Vector, SecondNumber="0.01")  # -> SmallerThan, OrEqualTo
cull_pattern_2 = CullPattern(List=cull_pattern, CullPattern=smaller_than_3.SmallerThan)  # -> flatten(List)

surface_mesh = SurfaceMesh(
    Name="QTS8",
    Size=Slider(0.05, range=0.001..0.1),
    Stored_MeshElementOrder="Quadratic",
    Stored_MeshShape="Quadrilateral",
    Stored_MeshType="ThickShell",
    Stored_Regularity=1)
surface_section = SurfaceSection(Name="Shell", Thickness=Slider(0.005, range=0.001..0.01))
library_material = LibraryMaterial(
    Name="Aluminum",
    Stored_Material_Grade="Ungraded",
    Stored_Material_Region="(None)",
    Stored_Material_Standard="(None)",
    Stored_Material_Type="Aluminium")  # -> Material, Density
surface_member = SurfaceMember(Brep=parameter_subdivide_surface, Material=library_material.Material, Section=surface_section, Mesh=surface_mesh)
panel = Panel("""call database.options.setBoolean("Option 311", false, false, "A1")
call database.options.setBoolean("Option 432", false, false, "A1")
set loadcase = database.getLoadset("LC1", 0)
call loadcase.setEigenvalueMaxMinControl("Frequency", "Minimum", 5)
call loadcase.getEigenvalueControl().setValue("nivc", 0).setValue("nitem", 30).setValue("namast", 0).setValue("shift", 0.0)
call loadcase.getEigenvalueControl().setValue("rtol", 0.1E-3).setValue("sturm", true).setValue("Guyan", false).setValue("buckl", false)
call loadcase.getEigenvalueControl().setValue("NormalisationProcedure", "GlobalMass").setValue("Eigensolver", "Default")
set loadcase = nothing""")
gravity = Gravity(Factor=1, Loadcase="LC1")
support = Support(Name="Fixed", TransSprings=Vector(0, 0, 0), RotSprings=Vector(0, 0, 0))
analysis = Analysis(Name="A1", Loadcases="LC1", Gravity=gravity, Stored_IsBaseAnalysis=True)
assign_line_support = AssignLineSupport(Curve=cull_pattern_2, Support=support)
lusas_model = LUSASModel(Member=surface_member, Analyses=analysis, Assignments=assign_line_support, Stored_Units="N,m,kg,s,C")
model_preview = ModelPreview(
    Model=lusas_model,
    Stored_Analysis="A1",
    Stored_Loadcase="LC1",
    Stored_PreviewLoads=True,
    Stored_PreviewSections=True,
    Stored_PreviewSupports=True,
    Stored_Scale=1)
live_link = LiveLink(
    Model=lusas_model,
    Append=panel,
    Run=Toggle(False),
    Stored_LastBrowsedDirectory="C:\Users\paulbd\Desktop\GRASSHOPPER\250331",
    Stored_LastExportFilename="MobiusStrip.mdl",
    Stored_LinkMode=0)
