# Grasshopper definition 06_LUSAS_GH_NetworkTiedArchBridge.gh (Grasshopper 1.0.8)
# plug-ins: LUSAS_Grasshopper

# ----
# SPAN
# RISE
# SUBDIVISIONS
#    (HANGERS)
# WIDTH
# INCLINATION
# SUBDIVISIONS
#    (BRACING)
span = Slider(100, range=0..150)
subdivisions = Slider(5, range=2..25)
inclination = Slider(19.3, range=0..30)
arch_subdivisions = Slider(9, range=0..20)
rise = Slider(34.4, range=0..100)
width = Slider(27.6, range=0..100)

construct_point = ConstructPoint(XCoordinate=0, YCoordinate=0, ZCoordinate=0)
construct_point_2 = ConstructPoint(XCoordinate=span, YCoordinate=0, ZCoordinate=0)
line = Line(StartPoint=construct_point, EndPoint=construct_point_2)
multiplication = Multiplication(A=span, B=0.5)
construct_point_3 = ConstructPoint(XCoordinate=multiplication, YCoordinate=0, ZCoordinate=rise)
point = Point([construct_point, construct_point_3, construct_point_2])
line_2 = Line(line)
interpolate = Interpolate(Vertices=point, Degree=3, Periodic=False, KnotStyle=1)  # -> Curve, Length, Domain
divide_curve = DivideCurve(Curve=line, Count=subdivisions, Kinks=False)  # -> Points, Tangents, Parameters
addition = Addition(A=subdivisions, B=2)
vector_xyz = VectorXYZ(XComponent=0, YComponent=width, ZComponent=0)  # -> Vector, Length
divide_curve_2 = DivideCurve(Curve=interpolate.Curve, Count=addition, Kinks=False)  # -> Points, Tangents, Parameters
cull_index = CullIndex(List=divide_curve.Points, Indices=0, Wrap=True)
move = Move(Geometry=line_2, Motion=vector_xyz.Vector)  # -> Geometry, Transform
line_3 = Line(StartPoint=divide_curve_2.Points, EndPoint=divide_curve.Points)  # -> flatten(Line)
cull_index_2 = CullIndex(List=divide_curve_2.Points, Indices=[0, 1, 2, -1], Wrap=True)
extrude = Extrude(Base=divide_curve.Points, Direction=vector_xyz.Vector)
end_points = EndPoints(Curve=move.Geometry)  # -> Start, End
point_2 = Point(end_points.Start)
point_3 = Point(end_points.End)
cull_index_3 = CullIndex(List=line_3, Indices=[0, -1, -2, -3], Wrap=True)  # -> flatten(List)
line_4 = Line(StartPoint=cull_index_2, EndPoint=cull_index)
cull_index_4 = CullIndex(List=line_4, Indices=-1, Wrap=True)
point_4 = Point(flatten([divide_curve.Points, divide_curve_2.Points]))
line_5 = Line(flatten([cull_index_4, cull_index_3]))
curve = Curve(flatten(interpolate.Curve))
geometry = Geometry([point_4, line_5, curve])
move_2 = Move(Geometry=geometry, Motion=vector_xyz.Vector)  # -> Geometry, Transform
rotate_axis = RotateAxis(Geometry=geometry, Angle=expr("-x", degrees(inclination)), Axis=line_2)  # -> Geometry, Transform
rotate_axis_2 = RotateAxis(Geometry=move_2.Geometry, Angle=degrees(inclination), Axis=move.Geometry)  # -> Geometry, Transform
match_text = MatchText(Text=rotate_axis.Geometry, Pattern="Line*", Case=True)
match_text_2 = MatchText(Text=rotate_axis.Geometry, Pattern="Line*", Case=True)
list_item = ListItem(List=rotate_axis.Geometry, Index=-1, Wrap=True)
list_item_2 = ListItem(List=rotate_axis_2.Geometry, Index=-1, Wrap=True)
cull_pattern = CullPattern(List=rotate_axis_2.Geometry, CullPattern=match_text)
cull_pattern_2 = CullPattern(List=rotate_axis.Geometry, CullPattern=match_text_2)
end_points_2 = EndPoints(Curve=cull_pattern)  # -> Start, End
end_points_3 = EndPoints(Curve=cull_pattern_2)  # -> Start, End
divide_curve_3 = DivideCurve(Curve=list_item, Count=arch_subdivisions, Kinks=False)  # -> Points, Tangents, Parameters
divide_curve_4 = DivideCurve(Curve=list_item_2, Count=arch_subdivisions, Kinks=False)  # -> Points, Tangents, Parameters
curve_2 = Curve(list_item_2)
point_5 = Point(end_points_2.Start)
point_6 = Point(end_points_3.Start)
curve_3 = Curve(list_item)
cull_index_5 = CullIndex(List=divide_curve_3.Points, Indices=[0, -2, -1], Wrap=True)  # -> flatten(List)
cull_index_6 = CullIndex(List=divide_curve_3.Points, Indices=[0, 1, -1], Wrap=True)
cull_index_7 = CullIndex(List=divide_curve_4.Points, Indices=[0, 1, -1], Wrap=True)  # -> flatten(List)
cull_index_8 = CullIndex(List=divide_curve_4.Points, Indices=[0, -2, -1], Wrap=True)
curve_closest_point = CurveClosestPoint(Point=point_5, Curve=curve_2)  # -> Point, Parameter, Distance
curve_closest_point_2 = CurveClosestPoint(Point=point_6, Curve=curve_3)  # -> Point, Parameter, Distance
shatter = Shatter(Curve=curve_2, Parameters=curve_closest_point.Parameter)  # -> graft(Segments)
shatter_2 = Shatter(Curve=curve_3, Parameters=curve_closest_point_2.Parameter)  # -> graft(Segments)
line_6 = Line(StartPoint=cull_index_5, EndPoint=cull_index_7)
line_7 = Line(StartPoint=cull_index_6, EndPoint=cull_index_8)
line_8 = Line(flatten([line_6, line_7]))
end_points_4 = EndPoints(Curve=line_8)  # -> Start, End
point_7 = Point(end_points_4.Start)
curve_closest_point_3 = CurveClosestPoint(Point=end_points_4.End, Curve=shatter)  # -> Point, Parameter, Distance
curve_closest_point_4 = CurveClosestPoint(Point=point_7, Curve=shatter_2)  # -> Point, Parameter, Distance
shatter_3 = Shatter(Curve=shatter, Parameters=curve_closest_point_3.Parameter)  # -> flatten(Segments)
shatter_4 = Shatter(Curve=shatter_2, Parameters=curve_closest_point_4.Parameter)  # -> flatten(Segments)
curve_4 = Curve([shatter_3, shatter_4])

# ----
# Girders
# Arches
# Cross-beams
# Hangers
# Supports
# Top bracing
panel = Panel("210000000000")
isotropic_material = IsotropicMaterial(Name="Steel", YoungsModulus=panel, Poisson="0.3", Density="7850")
line_9 = Line(extrude)
line_10 = Line([move.Geometry, line_2])
number_slider = Slider(0.1, range=0..0.2)
number_slider_2 = Slider(0.025, range=0..0.1)
line_line = LineLine(Line1=line_10, Line2=line_9)  # -> ParamA, ParamB, PointA, PointB
shatter_5 = Shatter(Curve=line_10, Parameters=line_line.ParamA)  # -> flatten(Segments)
line_11 = Line([cull_pattern, cull_pattern_2])
parametric_section = ParametricSection(Name="Hangers", D=number_slider, T=number_slider_2, Stored_SectionSubType="Hollow", Stored_SectionType="Circular")  # -> Section, Area
line_mesh = LineMesh(Name="ThickBeam", Length=Slider(1.5, range=0..10), Stored_MeshElementOrder="Linear", Stored_MeshType="ThickBeam")
parametric_section_2 = ParametricSection(
    Name="Arches",
    B=Slider(0.7, range=0..1),
    D=Slider(0.9, range=0..2),
    T=Slider(0.06, range=0..0.1),
    Stored_SectionSubType="Hollow",
    Stored_SectionType="Rectangular")  # -> Section, Area
parametric_section_3 = ParametricSection(
    Name="Girders",
    B=Slider(0.5, range=0..1),
    D=Slider(2.4, range=0..10),
    Tf=Slider(0.05, range=0..0.1),
    Tw=Slider(0.025, range=0..0.1),
    Stored_SectionSubType="Standard",
    Stored_SectionType="I")  # -> Section, Area
curve_5 = Curve(curve_4)
line_mesh_2 = LineMesh(Name="Bar", Divisions="1", Stored_MeshElementOrder="Linear", Stored_MeshType="Bar")
parametric_section_4 = ParametricSection(
    Name="Cross-beams",
    B=Slider(0.6, range=0..1),
    D=Slider(1.1, range=0..2),
    Tf=Slider(0.03, range=0..0.1),
    Tw=Slider(0.016, range=0..0.1),
    Stored_SectionSubType="Standard",
    Stored_SectionType="I")  # -> Section, Area
line_12 = Line(line_9)
line_member = LineMember(Curve=line_11, Material=isotropic_material, Section=parametric_section.Section, Mesh=line_mesh_2)
line_member_2 = LineMember(Curve=curve_5, Material=isotropic_material, Section=parametric_section_2.Section, Mesh=line_mesh)
line_member_3 = LineMember(Curve=shatter_5, Material=isotropic_material, Section=parametric_section_3.Section, Mesh=line_mesh)
parametric_section_5 = ParametricSection(Name="Top Bracing", D=number_slider, T=number_slider_2, Stored_SectionSubType="Hollow", Stored_SectionType="Circular")  # -> Section, Area
curve_6 = Curve(line_8)
line_member_4 = LineMember(Curve=line_12, Material=isotropic_material, Section=parametric_section_4.Section, Mesh=line_mesh)
line_member_5 = LineMember(Curve=curve_6, Material=isotropic_material, Section=parametric_section_5.Section, Mesh=line_mesh_2)
support = Support(Name="Pin", TransSprings=Vector(0, 0, 0), RotSprings=Vector(0, 0, 0))
support_2 = Support(Name="Roller", TransSprings=Vector(0, 0, 0), RotSprings=Vector(0, 0, 0))
point_8 = Point([point_3, construct_point_2])
point_9 = Point([construct_point, point_2])
gravity = Gravity(Factor=1, Loadcase="LC1")
assign_point_support = AssignPointSupport(Points=point_8, Support=support_2, Analysis="A1")
assign_point_support_2 = AssignPointSupport(Points=point_9, Support=support, Analysis="A1")
analysis = Analysis(Name="A1", Loadcases="LC1", Gravity=gravity, Stored_IsBaseAnalysis=True)
model = Model(
    Member=[line_member_3, line_member_2, line_member_4, line_member, line_member_5],
    Analyses=analysis,
    Assignments=[assign_point_support, assign_point_support_2],
    Stored_Units="N,m,kg,s,C")
model_preview = ModelPreview(
    Model=model,
    Stored_Analysis="A1",
    Stored_Loadcase="LC1",
    Stored_PreviewLoads=True,
    Stored_PreviewSections=True,
    Stored_PreviewSupports=True,
    Stored_Scale=1)
live_link = LiveLink(
    Model=model,
    Run=Toggle(False),
    Stored_LastBrowsedDirectory="C:\Users\paulbd\Desktop\GRASSHOPPER\250331",
    Stored_LastExportFilename="NetworkTiedArchBridge.mdl",
    Stored_LinkMode=0)
