# Grasshopper definition 07_LUSAS_GH_SphericalTank.gh (Grasshopper 1.0.8)
# plug-ins: LUSAS_Grasshopper

# ----
# Support Height
# Tank Radius
# Number of Supports
# Post Diameter
# Brace Location
# along the Post
support_height = Slider(10, range=0..15)
radius = Slider(7, range=0..20)
number_of_supports = Slider(12, range=0..24)
diameter = Slider(0.6, range=0..1)
brace_location = Slider(0.63, range=0..1)

pi = Pi(Factor=1)
circle = Circle(Plane=PlaneXY(0, 0, 0), Radius=radius)
multiplication = Multiplication(A="2", B=pi)
vector_xyz = VectorXYZ(XComponent=0, YComponent=0, ZComponent=expr("-x", support_height))  # -> Vector, Length
construct_point = ConstructPoint(XCoordinate=0, YCoordinate=0, ZCoordinate=0)
construct_point_2 = ConstructPoint(XCoordinate=0, YCoordinate=0, ZCoordinate="1")
division = Division(A=multiplication, B=number_of_supports)
division_2 = Division(A=number_of_supports, B="2")
divide_curve = DivideCurve(Curve=circle, Count=number_of_supports, Kinks=False)  # -> Points, Tangents, Parameters
rotate_axis = RotateAxis(Geometry=circle, Angle=1.570796327, Axis=Line((0, 0, 0), (10, 0, 0)))  # -> Geometry, Transform
line = Line(StartPoint=construct_point, EndPoint=construct_point_2)
series = Series(Start=0, Step=division, Count=division_2)
move = Move(Geometry=divide_curve.Points, Motion=vector_xyz.Vector)  # -> Geometry, Transform
sphere_fit = SphereFit(Points=divide_curve.Points)  # -> Center, Radius, Sphere
rotate_axis_2 = RotateAxis(Geometry=rotate_axis.Geometry, Angle=series, Axis=line)  # -> Geometry, Transform
multiplication_2 = Multiplication(A=support_height, B=brace_location)
line_2 = Line(StartPoint=move.Geometry, EndPoint=divide_curve.Points)
divide_distance = DivideDistance(Curve=line_2, Distance=multiplication_2)  # -> Points, Tangents, flatten(Parameters)
curve = Curve(flatten([circle, rotate_axis_2.Geometry]))
brep = Brep(sphere_fit.Sphere)
divide_curve_2 = DivideCurve(Curve=rotate_axis_2.Geometry, Count="4", Kinks=False)  # -> Points, Tangents, flatten(Parameters)
divide_curve_3 = DivideCurve(Curve=circle, Count=number_of_supports, Kinks=False)  # -> Points, Tangents, Parameters
shatter = Shatter(Curve=line_2, Parameters=divide_distance.Parameters)  # -> flatten(Segments)
surface_split = SurfaceSplit(Surface=brep, Curves=curve)
shatter_2 = Shatter(Curve=rotate_axis_2.Geometry, Parameters=divide_curve_2.Parameters)  # -> flatten(Segments)
shatter_3 = Shatter(Curve=circle, Parameters=divide_curve_3.Parameters)
negative = Negative(Value=multiplication_2)
vector_xyz_2 = VectorXYZ(XComponent=0, YComponent=0, ZComponent=negative)  # -> Vector, Length
end_points = EndPoints(Curve=shatter)  # -> Start, End
curve_2 = Curve(flatten([shatter_2, shatter_3]))
point = Point(end_points.End)
move_2 = Move(Geometry=circle, Motion=vector_xyz_2.Vector)  # -> Geometry, Transform
rebuild_curve = RebuildCurve(Curve=curve_2, Degree=2, Count=10, Tangents=False)
deconstruct = Deconstruct(Point=point)  # -> XComponent, YComponent, ZComponent
sort_list = SortList(Keys=deconstruct.ZComponent, ValuesValuesA=point)  # -> Keys, ValuesValuesA
series_2 = Series(Start=0, Step=1, Count=number_of_supports)
point_2 = Point(sort_list.ValuesValuesA)
list_item = ListItem(List=point_2, Index=series_2, Wrap=True)  # -> flatten(Item)
sort_along_curve = SortAlongCurve(Points=list_item, Curve=move_2.Geometry)  # -> Points, Indices

thickness = Slider(25, range=0..100)
thickness_2 = Slider(40, range=0..100)
panel = Panel("""set attr = database.createLoadingLocalDistributed("Pressure")
call attr.setLocalDistributed(0.0, 0.0, "700.0E3", "surface")
call attr.setAnalysisCategory("3D")
set attr = nothing""")
diameter_2 = Slider(0.5, range=0..1)
division_3 = Division(A=thickness, B="1000")
mesh_size = Slider(1.5, range=0..3)
division_4 = Division(A=thickness_2, B="1000")
parametric_section = ParametricSection(Name="Posts", D=diameter, T=division_3, Stored_SectionSubType="Hollow", Stored_SectionType="Circular")  # -> Section, Area
line_3 = Line(shatter)
line_mesh = LineMesh(Name="Bar", Divisions="1", Stored_MeshElementOrder="Linear", Stored_MeshType="Bar")
parametric_section_2 = ParametricSection(Name="Braces", D=diameter_2, T=division_4, Stored_SectionSubType="Hollow", Stored_SectionType="Circular")  # -> Section, Area
surface_section = SurfaceSection(Name="Shell", Thickness=Slider(0.025, range=0.01..0.05))
line_mesh_2 = LineMesh(Name="Meridians", Stored_MeshElementOrder="Linear", Stored_MeshType="None")
surface_mesh = SurfaceMesh(
    Name="ThickShell",
    Size=Slider(1, range=0.2..3),
    Stored_MeshElementOrder="Linear",
    Stored_MeshShape="Quadrilateral",
    Stored_MeshType="ThickShell",
    Stored_Regularity=1)
line_mesh_3 = LineMesh(Name="ThickBeam", Length=mesh_size, Stored_MeshElementOrder="Linear", Stored_MeshType="ThickBeam")
custom_attribute = CustomAttribute(DefineLPI=panel)
brep_2 = Brep(surface_split)
curve_3 = Curve(rebuild_curve)
line_member = LineMember(Curve=curve_3, Mesh=line_mesh_2)
point_3 = Point(flatten(move.Geometry))
library_material = LibraryMaterial(
    Name="Steel",
    Stored_Material_Grade="Mild Steel",
    Stored_Material_Region="(None)",
    Stored_Material_Standard="(None)",
    Stored_Material_Type="Steel - Structural")  # -> Material, Density
surface_member = SurfaceMember(
    Brep=brep_2,
    Material=library_material.Material,
    Section=surface_section,
    Mesh=surface_mesh,
    CustomAttrs=custom_attribute)
line_member_2 = LineMember(Curve=line_3, Material=library_material.Material, Section=parametric_section.Section, Mesh=line_mesh_3)
support = Support(Name="Pin", TransSprings=Vector(0, 0, 0), RotSprings=Vector(0, 0, 0))
gravity = Gravity(Factor=1, Loadcase="LC1")
analysis = Analysis(Name="A1", Loadcases="LC1", Gravity=gravity, Stored_IsBaseAnalysis=True)
assign_point_support = AssignPointSupport(Point=point_3, Support=support, Analysis="A1")

shift_list = ShiftList(List=point_3, Shift=1, Wrap=True)  # -> flatten(List)
shift_list_2 = ShiftList(List=point_3, Shift=-1, Wrap=True)
line_4 = Line(StartPoint=sort_along_curve.Points, EndPoint=shift_list)
line_5 = Line(StartPoint=sort_along_curve.Points, EndPoint=shift_list_2)
line_6 = Line([line_4, line_5])

line_7 = Line(line_6)
line_member_3 = LineMember(Curve=line_7, Material=library_material.Material, Section=parametric_section_2.Section, Mesh=line_mesh)
lusas_model = LUSASModel(
    Member=[line_member_3, line_member_2, surface_member],
    Analyses=analysis,
    Assignments=assign_point_support,
    Stored_Units="N,m,kg,s,C")
model_preview = ModelPreview(
    Model=lusas_model,
    Stored_Analysis="A1",
    Stored_Loadcase="LC1",
    Stored_PreviewLoads=True,
    Stored_PreviewSections=True,
    Stored_PreviewSupports=True,
    Stored_Scale=1)
live_link = LiveLink(
    Model=lusas_model,
    Run=Toggle(False),
    Stored_LastBrowsedDirectory="C:\Users\paulbd\Desktop\GRASSHOPPER\250331",
    Stored_LastExportFilename="SphericalTank.mdl",
    Stored_LinkMode=0)
