# Grasshopper definition 08_LUSAS_GH_TwinGirderBridgeWithVLO.gh (Grasshopper 1.0.8)
# plug-ins: LUSAS_Grasshopper

# ----
# Overhang Width
# Half Girder Spacing
# Span
# Deck Thickness
overhang_width = Slider(2.5, range=0.1..5)
span = Slider(40, range=0..100)
half_girder_spacing = Slider(3, range=0..10)
deck_thickness = Slider(0.2, range=0..1)

negative = Negative(Value=overhang_width)
construct_point = ConstructPoint(XCoordinate=0, YCoordinate=0, ZCoordinate=0)
construct_point_2 = ConstructPoint(XCoordinate=span, YCoordinate=0, ZCoordinate=0)
vector_xyz = VectorXYZ(XComponent=0, YComponent=negative, ZComponent=0)  # -> Vector, Length
vector_xyz_2 = VectorXYZ(XComponent=0, YComponent=half_girder_spacing, ZComponent=0)  # -> Vector, Length
line = Line(StartPoint=construct_point, EndPoint=construct_point_2)
construct_point_3 = ConstructPoint(XCoordinate=0, YCoordinate=half_girder_spacing, ZCoordinate=0)
construct_point_4 = ConstructPoint(XCoordinate="1", YCoordinate=half_girder_spacing, ZCoordinate=0)
extrude = Extrude(Base=line, Direction=vector_xyz.Vector)
extrude_2 = Extrude(Base=line, Direction=vector_xyz_2.Vector)
end_points = EndPoints(Curve=line)  # -> Start, End
line_2 = Line(StartPoint=construct_point_3, EndPoint=construct_point_4)
brep = Brep([extrude, extrude_2])
mirror_curve = MirrorCurve(Geometry=brep, Curve=line_2, Tangent=True)
mirror_curve_2 = MirrorCurve(Geometry=line, Curve=line_2, Tangent=True)
brep_edges = BrepEdges(Brep=extrude)  # -> Naked, Interior, NonManifold
line_3 = Line(brep_edges.Naked)
brep_edges_2 = BrepEdges(Brep=mirror_curve)  # -> Naked, Interior, NonManifold
end_points_2 = EndPoints(Curve=mirror_curve_2)  # -> Start, End
list_item = ListItem(List=line_3, Index="1", Wrap=True)
line_4 = Line(flatten(brep_edges_2.Naked))
list_item_2 = ListItem(List=line_4, Index="1", Wrap=True)

# ----
# Script that creates the beam/shell slice utilities
# Script that creates the beam/shell envelope influences
# Script that creates the search area custom attribute
# Script that creates the direct influence surface analysis
# Script that merges a couple lines
panel = Panel("""call selection.remove("All")
set attr = database.createInfluenceEnvelope("Inf1")
call attr.setResultsTransformNone()
call attr.setEntity("Beam/Shell Slice Resultants")
redim componentNamesArray(1)
componentNamesArray(0) = "Fz"
componentNamesArray(1) = "My"
call attr.addComponentNames(componentNamesArray)
erase componentNamesArray
call attr.includeCoincident(false)
set attr = nothing""")
panel_2 = Panel("""set dirInfAnalysis = database.createAnalysisDirectMethodInf("Direct Method Influence Analysis 1")
call dirInfAnalysis.setLoadDirection("Vertical")
call dirInfAnalysis.setLoadMagnitude(1.0E3)
call dirInfAnalysis.setSearchArea("Srch1")
call dirInfAnalysis.setSearchAssignType("area")
call dirInfAnalysis.setIsGrillageType(1)
call dirInfAnalysis.setGridCentreline("")
call dirInfAnalysis.setIncludeMidSideNodes(false)
call dirInfAnalysis.createElements()
call dirInfAnalysis.setSelectedResultsGroup("assignments")
call dirInfAnalysis.setSelectedElementOutputGroup("all")
call dirInfAnalysis.setSelectedNodeOutputGroup("all")
set dirInfAnalysis = nothing
set attr = database.getAttribute("Influence Envelope", "Inf1")
call attr.assignToBeamShellSlice("BeamShell1", "Direct Method Influence Analysis 1")
call attr.assignToBeamShellSlice("BeamShell2", "Direct Method Influence Analysis 1")""")
panel_3 = Panel("""call selection.remove("All")
call database.options.setBoolean("associateDown", false)
call selection.add("Line", "All")
call database.options.setBoolean("associateDown", true)
'selection now contains:;L1;L2;L3;L5;L6;L7;L8;L9;L10;L11;L12;L13;L14;L15;L16
call geometryData.setAllDefaults()
call geometryData.setLowerOrderGeometryType("lines")
set returnedSetA = selection.makeMergeable(geometryData)
call database.updateMesh()
set dirInfAnalysis = database.getAnalysis("Direct Method Influence Analysis 1")
call dirInfAnalysis.reset()
call dirInfAnalysis.createElements()
set dirInfAnalysis = nothing
call selection.remove("All")""")
panel_4 = Panel("""call selection.remove("All")
call selection.add("Line", "1")
'selection now contains:;L1
set slice = database.createBeamShellSlice("BeamShell1")
call slice.setBeamShellSlice(4, "3", -1, 0.0, -1, 0, 0.0, 0, -1, "Slice", 2, "G1", "1", 0.0)
set slice = nothing
call selection.remove("All")
call selection.add("Line", "2")
'selection now contains:;L2
set slice = database.createBeamShellSlice("BeamShell2")
call slice.setBeamShellSlice(4, "3", -1, 0.0, -1, 0, 0.0, 0, -1, "Slice", 2, "G2", "2", 0.0)
set slice = nothing
call selection.remove("All")""")
panel_5 = Panel("""set attr = database.createSearchArea("Srch1")
set attr = nothing""")
custom_attribute = CustomAttribute(DefineLPI=panel_5)

web_thickness = Slider(0.015, range=0..0.1)
flange_thickness = Slider(0.025, range=0..0.1)
width = Slider(0.5, range=0..1)
depth = Slider(1.3, range=0..2)
web_thickness_2 = Slider(0.015, range=0..0.1)
flange_thickness_2 = Slider(0.025, range=0..0.1)
width_2 = Slider(0.5, range=0..1)
depth_2 = Slider(1.3, range=0..2)
surface_section = SurfaceSection(Name="Deck 2", Thickness=deck_thickness)
division = Division(A=deck_thickness, B="2")
surface_section_2 = SurfaceSection(Name="Deck 1", Thickness=deck_thickness)
division_2 = Division(A=depth, B="2")
division_3 = Division(A=deck_thickness, B="2")
division_4 = Division(A=depth_2, B="2")
parametric_section = ParametricSection(
    Name="Girder 2",
    B=width,
    D=depth,
    Tf=flange_thickness,
    Tw=web_thickness,
    Stored_SectionSubType="Standard",
    Stored_SectionType="I")  # -> Section, Area
parametric_section_2 = ParametricSection(
    Name="Girder 1",
    B=width_2,
    D=depth_2,
    Tf=flange_thickness_2,
    Tw=web_thickness_2,
    Stored_SectionSubType="Standard",
    Stored_SectionType="I")  # -> Section, Area
brep_2 = Brep(brep)
brep_3 = Brep(mirror_curve)
addition = Addition(A=division_2, B=division)
addition_2 = Addition(A=division_4, B=division_3)
line_member = LineMember(Curve=[list_item_2, list_item], Groups="Kerbs")
assign_section = AssignSection(Section=parametric_section.Section, EccZ=addition, EccY=0)
assign_section_2 = AssignSection(Section=parametric_section_2.Section, EccZ=addition_2, EccY=0)
line_5 = Line(line)
line_6 = Line(mirror_curve_2)
library_material = LibraryMaterial(
    Name="Steel",
    Stored_Material_Grade="Ungraded",
    Stored_Material_Region="USA",
    Stored_Material_Standard="AASHTO LRFD 4th-9th",
    Stored_Material_Type="Steel - Structural")  # -> Material, Density
library_material_2 = LibraryMaterial(
    Name="Concrete",
    Stored_Material_Grade="5.0ksi",
    Stored_Material_Region="USA",
    Stored_Material_Standard="AASHTO LRFD 8th-9th",
    Stored_Material_Type="Concrete")  # -> Material, Density
gravity = Gravity(Factor=1, Loadcase="LC1")
mesh_size = Slider(1.5, range=0..10)
mesh_size_2 = Slider(1.5, range=0..10)
analysis = Analysis(Name="A1", Loadcases="LC1", Gravity=gravity, Stored_IsBaseAnalysis=True)
support = Support(Name="XYZ", TransSprings=Vector(0, 0, 0), RotSprings=Vector(0, 0, 0))
support_2 = Support(Name="YZ", TransSprings=Vector(0, 0, 0), RotSprings=Vector(0, 0, 0))
support_3 = Support(Name="Z", TransSprings=Vector(0, 0, 0), RotSprings=Vector(0, 0, 0))
support_4 = Support(Name="XZ", TransSprings=Vector(0, 0, 0), RotSprings=Vector(0, 0, 0))
surface_mesh = SurfaceMesh(
    Name="Thick Shell",
    Size=mesh_size,
    Stored_MeshElementOrder="Linear",
    Stored_MeshShape="Quadrilateral",
    Stored_MeshType="ThickShell",
    Stored_Regularity=0)
surface_member = SurfaceMember(
    Brep=brep_3,
    Material=library_material_2.Material,
    Section=surface_section,
    Mesh=surface_mesh,
    CustomAttrs=custom_attribute,
    Groups="G2")
surface_member_2 = SurfaceMember(
    Brep=brep_2,
    Material=library_material_2.Material,
    Section=surface_section_2,
    Mesh=surface_mesh,
    CustomAttrs=custom_attribute,
    Groups="G1")
line_mesh = LineMesh(Name="ThickBeam", Length=mesh_size_2, Stored_MeshElementOrder="Linear", Stored_MeshType="ThickBeam")
line_member_2 = LineMember(Curve=line_6, Material=library_material.Material, Section=assign_section, Mesh=line_mesh, Groups="G2")
line_member_3 = LineMember(Curve=line_5, Material=library_material.Material, Section=assign_section_2, Mesh=line_mesh, Groups="G1")
assign_point_support = AssignPointSupport(Point=end_points.End, Support=support_2)
assign_point_support_2 = AssignPointSupport(Point=end_points.Start, Support=support)
assign_point_support_3 = AssignPointSupport(Point=end_points_2.End, Support=support_3)
assign_point_support_4 = AssignPointSupport(Point=end_points_2.Start, Support=support_4)
lusas_model = LUSASModel(
    Member=[line_member_3, surface_member_2, line_member, surface_member, line_member_2],
    Analyses=analysis,
    Assignments=[assign_point_support_2, assign_point_support, assign_point_support_3, assign_point_support_4],
    Stored_Units="N,m,kg,s,C")
model_preview = ModelPreview(
    Model=lusas_model,
    Stored_Analysis="A1",
    Stored_Loadcase="LC1",
    Stored_PreviewLoads=True,
    Stored_PreviewSections=True,
    Stored_PreviewSupports=True,
    Stored_Scale=1)
live_link = LiveLink(
    Model=lusas_model,
    Append=[panel_4, panel, panel_2, panel_3],
    Run=Toggle(False),
    Stored_LastBrowsedDirectory="C:\Users\paulbd\Desktop\GRASSHOPPER\250331",
    Stored_LastExportFilename="TwinGirderBridgeWithVLO.mdl",
    Stored_LinkMode=0)
