# Grasshopper definition 09_LUSAS_GH_TwistingTower.gh (Grasshopper 1.0.8)
# plug-ins: LUSAS_Grasshopper

length = Slider(25, range=0..100)
division = Division(A=length, B="2")
division_2 = Division(A=length, B="2")
rectangle = Rectangle(Plane=PlaneXY(0, 0, 0), XSize=length, YSize=length, Radius=0)  # -> Rectangle, Length
multiplication = Multiplication(A=division_2, B="-1")
multiplication_2 = Multiplication(A=division, B="-1")
vector_xyz = VectorXYZ(XComponent=multiplication_2, YComponent=multiplication, ZComponent=0)  # -> Vector, Length
floor_to_floor_height = Slider(4, range=0..10)
number_of_floors = Slider(51, range=0..100)
move = Move(Geometry=rectangle.Rectangle, Motion=vector_xyz.Vector)  # -> Geometry, Transform
angle_of_twist = Slider(1.8, range=0..10)
series = Series(Start=0, Step=floor_to_floor_height, Count=number_of_floors)
pi = Pi(Factor=1)
vector_xyz_2 = VectorXYZ(XComponent=0, YComponent=0, ZComponent=series)  # -> Vector, Length
division_3 = Division(A=pi, B="180")
multiplication_3 = Multiplication(A=angle_of_twist, B=division_3)
move_2 = Move(Geometry=move.Geometry, Motion=vector_xyz_2.Vector)  # -> Geometry, Transform
series_2 = Series(Start=0, Step=multiplication_3, Count=number_of_floors)
rotate = Rotate(Geometry=move_2.Geometry, Angle=series_2, Plane=PlaneXY(0, 0, 0))  # -> Geometry, Transform
loft = Loft(Curves=rotate.Geometry, Options={Adjust=False, Closed=False, LoftEnds=0, LoftSimp=0, LoftType=0, Rebuild=10, Refit=0.01})
explode = Explode(Curve=rotate.Geometry, Recursive=True)  # -> Segments, Vertices
explode_2 = Explode(Curve=rotate.Geometry, Recursive=True)  # -> Segments, Vertices
point_on_curve = PointOnCurve(explode.Segments, parameter=0.75)
point_on_curve_2 = PointOnCurve(explode.Segments, parameter=0.5)
point_on_curve_3 = PointOnCurve(explode.Segments, parameter=0.25)
flip_matrix = FlipMatrix(Data=point_on_curve_3)
flip_matrix_2 = FlipMatrix(Data=point_on_curve_2)
flip_matrix_3 = FlipMatrix(Data=explode.Vertices)
flip_matrix_4 = FlipMatrix(Data=point_on_curve)
polyline = PolyLine(Vertices=flip_matrix, Closed=False)  # -> flatten(Polyline)
polyline_2 = PolyLine(Vertices=flip_matrix_2, Closed=False)  # -> flatten(Polyline)
polyline_3 = PolyLine(Vertices=flip_matrix_4, Closed=False)  # -> flatten(Polyline)
polyline_4 = PolyLine(Vertices=flip_matrix_3, Closed=False)  # -> flatten(Polyline)
polyline_5 = PolyLine(Vertices=explode_2.Vertices, Closed=False)  # -> flatten(Polyline)
divide_curve = DivideCurve(Curve=polyline_5, Count="16", Kinks=False)  # -> Points, Tangents, flatten(Parameters)
cull_index = CullIndex(List=polyline_4, Indices="0", Wrap=True)
curve = Curve(flatten([polyline, polyline_2, polyline_3, cull_index]))
shatter = Shatter(Curve=polyline_5, Parameters=divide_curve.Parameters)  # -> flatten(Segments)
boundary_surfaces = BoundarySurfaces(Edges=shatter)
brep = Brep(boundary_surfaces)
curve_2 = Curve(shatter)
isotropic_material = IsotropicMaterial(Name="C50/60", YoungsModulus="3.278e10", Poisson="0.2", Density="2500")
parametric_section = ParametricSection(
    Name="Columns",
    B=Slider(0.9, range=0..2),
    D=Slider(0.9, range=0..2),
    Stored_SectionSubType="Solid",
    Stored_SectionType="Rectangular")  # -> Section, Area
parametric_section_2 = ParametricSection(
    Name="Beams",
    B=Slider(0.9, range=0..2),
    D=Slider(0.8, range=0..1),
    Stored_SectionSubType="Solid",
    Stored_SectionType="Rectangular")  # -> Section, Area
isotropic_material_2 = IsotropicMaterial(Name="C35/45", YoungsModulus="3.4077E10", Poisson="0.2", Density="2500")
line_mesh = LineMesh(Name="ThickBeam", Length=Slider(2, range=0..10), Stored_MeshElementOrder="Linear", Stored_MeshType="ThickBeam")
surface_mesh = SurfaceMesh(
    Name="ThickShell",
    Size=Slider(2, range=0..3),
    Stored_MeshElementOrder="Linear",
    Stored_MeshShape="Quadrilateral",
    Stored_MeshType="ThickShell",
    Stored_Regularity=1)
surface_section = SurfaceSection(Name="S_0.25", Thickness=Slider(0.25, range=0..1))
line_member = LineMember(Curve=curve, Material=isotropic_material, Section=parametric_section.Section, Mesh=line_mesh)
line_member_2 = LineMember(Curve=curve_2, Material=isotropic_material, Section=parametric_section_2.Section, Mesh=line_mesh)
surface_member = SurfaceMember(Brep=brep, Material=isotropic_material_2, Section=surface_section, Mesh=surface_mesh)
lusas_model = LUSASModel(Member=[line_member, line_member_2, surface_member], Stored_Units="N,m,kg,s,C")
model_preview = ModelPreview(
    Model=lusas_model,
    Stored_Analysis="Analysis 1",
    Stored_Loadcase="Loadcase 1",
    Stored_PreviewLoads=True,
    Stored_PreviewSupports=True,
    Stored_Scale=1)
link_to_lusas = LinkToLUSAS(
    Model=lusas_model,
    Stored_LastBrowsedDirectory="C:\Users\paulbd\Desktop\GRASSHOPPER\WEBINAR - FEBRUARY 2025\Twisting Tower",
    Stored_LastExportFilename="241218pbd_TwistingTower.mdl",
    Stored_ModeIsModel=True)
