# Grasshopper definition 10_LUSAS_GH_UFrameBridge.gh (Grasshopper 1.0.8)
# plug-ins: LUSAS_Grasshopper

supports = Slider(1039, range=0..10000)
length = Slider(15134, range=0..100000)
negative = Negative(Value=supports)
construct_point = ConstructPoint(XCoordinate=0, YCoordinate=0, ZCoordinate=0)
vector_xyz = VectorXYZ(XComponent=length, YComponent=0, ZComponent=0)  # -> Vector, Length
vector_xyz_2 = VectorXYZ(XComponent=supports, YComponent=0, ZComponent=0)  # -> Vector, Length
vector_xyz_3 = VectorXYZ(XComponent=negative, YComponent=0, ZComponent=0)  # -> Vector, Length
move = Move(Geometry=construct_point, Motion=vector_xyz.Vector)  # -> Geometry, Transform
move_2 = Move(Geometry=construct_point, Motion=vector_xyz_2.Vector)  # -> Geometry, Transform
move_3 = Move(Geometry=move.Geometry, Motion=vector_xyz_3.Vector)  # -> Geometry, Transform
subdivisions = Slider(6, range=0..20)
line = Line(StartPoint=construct_point, EndPoint=move.Geometry)
line_2 = Line(StartPoint=move_2.Geometry, EndPoint=move_3.Geometry)
supp = Support(RS=Vector(0, 0, 0), RotSpr=Vector(0, 0, 0))
supp_2 = Support(RS=Vector(0, 0, 0), RotSpr=Vector(0, 0, 0))
supp_3 = Support(RS=Vector(0, 0, 0), RotSpr=Vector(0, 0, 0))
multiplication = Multiplication(A=subdivisions, B="4")
divide_curve = DivideCurve(Curve=line_2, Count=subdivisions, Kinks=False)  # -> Points, Tangents, Parameters
divide_curve_2 = DivideCurve(Curve=line_2, Count=multiplication, Kinks=False)  # -> Points, Tangents, Parameters
assignptsupp = AssignPointSupport(Points=move_2.Geometry, Support=supp, Analysis="Analysis 1")
assignptsupp_2 = AssignPointSupport(Points=move_3.Geometry, Support=supp_2, Analysis="Analysis 1")
depth = Slider(787, range=0..1000)
cull_nth = CullNth(List=divide_curve_2.Points, CullFrequency=2)
vector_xyz_4 = VectorXYZ(XComponent=0, YComponent=0, ZComponent=depth)  # -> Vector, Length
move_4 = Move(Geometry=line, Motion=vector_xyz_4.Vector)  # -> Geometry, Transform
set_difference = SetDifference(SetA=divide_curve_2.Points, SetB=cull_nth)
move_5 = Move(Geometry=divide_curve.Points, Motion=vector_xyz_4.Vector)  # -> Geometry, Transform
line_3 = Line(StartPoint=divide_curve.Points, EndPoint=move_5.Geometry)
width = Slider(2638, range=0..10000)
vector_xyz_5 = VectorXYZ(XComponent=0, YComponent=width, ZComponent=0)  # -> Vector, Length
move_6 = Move(Geometry=line, Motion=vector_xyz_5.Vector)  # -> Geometry, Transform
move_7 = Move(Geometry=move_2.Geometry, Motion=vector_xyz_5.Vector)  # -> Geometry, Transform
assignptsupp_3 = AssignPointSupport(Points=move_7.Geometry, Support=supp_3, Analysis="Analysis 1")
move_8 = Move(Geometry=move_3.Geometry, Motion=vector_xyz_5.Vector)  # -> Geometry, Transform
assignptsupp_4 = AssignPointSupport(Points=move_8.Geometry, Support=supp_3, Analysis="Analysis 1")
move_9 = Move(Geometry=move_4.Geometry, Motion=vector_xyz_5.Vector)  # -> Geometry, Transform
move_10 = Move(Geometry=set_difference, Motion=vector_xyz_5.Vector)  # -> Geometry, Transform
move_11 = Move(Geometry=line_3, Motion=vector_xyz_5.Vector)  # -> Geometry, Transform
line_4 = Line(StartPoint=set_difference, EndPoint=move_10.Geometry)
line_5 = Line(flatten([move_11.Geometry, line_4]))
line_6 = Line(flatten([line_4, line_3]))
llx = LineLine(Line1=move_9.Geometry, Line2=line_5)  # -> ParamA, ParamB, PointA, PointB
llx_2 = LineLine(Line1=move_6.Geometry, Line2=line_5)  # -> ParamA, ParamB, PointA, PointB
llx_3 = LineLine(Line1=move_4.Geometry, Line2=line_6)  # -> ParamA, ParamB, PointA, PointB
llx_4 = LineLine(Line1=line, Line2=line_6)  # -> ParamA, ParamB, PointA, PointB
shatter = Shatter(Curve=line, Parameters=llx_4.ParamA)  # -> flatten(Segments)
shatter_2 = Shatter(Curve=move_4.Geometry, Parameters=llx_3.ParamA)
shatter_3 = Shatter(Curve=move_6.Geometry, Parameters=llx_2.ParamA)
shatter_4 = Shatter(Curve=move_9.Geometry, Parameters=llx.ParamA)
line_7 = Line([shatter_4, shatter_2])
line_8 = Line(flatten([shatter, shatter_3]))
extrude = Extrude(Base=line_8, Direction=vector_xyz_4.Vector)
brep = Brep(extrude)
line_9 = Line([move_11.Geometry, line_3])
division = Division(A=Slider(7850, range=0..10000), B="1000000000000")
isotropic_material = IsotropicMaterial(
    Name="Steel",
    YoungsModulus=Slider(210000, range=0..1000000),
    Poisson=Slider(0.3, range=0..1),
    Density=division,
    Thermal=Slider(1e-05, range=0..1e-05))
line_mesh = LineMesh(Name="BMI21", Length=Slider(250, range=0..1000), Stored_MeshElementOrder="Linear", Stored_MeshType="ThickBeam")
parametric_section = ParametricSection(
    Name="Bottom flange",
    B=Slider(305, range=0..1000),
    D=Slider(64, range=0..100),
    Stored_SectionSubType="Solid",
    Stored_SectionType="Rectangular")  # -> Section, Area
parametric_section_2 = ParametricSection(
    Name="Top flange",
    B=Slider(305, range=0..1000),
    D=Slider(64, range=0..100),
    Stored_SectionSubType="Solid",
    Stored_SectionType="Rectangular")  # -> Section, Area
surface_mesh = SurfaceMesh(
    Name="QTS4",
    Size=Slider(250, range=0..1000),
    Stored_MeshElementOrder="Linear",
    Stored_MeshShape="Quadrilateral",
    Stored_MeshType="ThickShell",
    Stored_Regularity=0)
parametric_section_3 = ParametricSection(
    Name="Stiffeners",
    B=Slider(305, range=0..1000),
    D=Slider(12.7, range=0..100),
    Stored_SectionSubType="Solid",
    Stored_SectionType="Rectangular")  # -> Section, Area
parametric_section_4 = ParametricSection(
    Name="Cross-beams",
    B=Slider(203, range=0..1000),
    D=Slider(203, range=0..1000),
    Tf=Slider(11.1, range=0..100),
    Tw=Slider(7.3, range=0..10),
    R=Slider(0, range=0..100),
    Stored_SectionSubType="Standard",
    Stored_SectionType="I")  # -> Section, Area
surface_section = SurfaceSection(Name="S_12.7", Thickness=Slider(12.7, range=0..100))
surface_member = SurfaceMember(Brep=brep, Material=isotropic_material, Section=surface_section, Mesh=surface_mesh)
linemember = LineMember(Curve=line_4, Material=isotropic_material, Section=parametric_section_4.Section, Mesh=line_mesh)
linemember_2 = LineMember(Curve=line_8, Material=isotropic_material, Section=parametric_section.Section, Mesh=line_mesh)
linemember_3 = LineMember(Curve=line_9, Material=isotropic_material, Section=parametric_section_3.Section, Mesh=line_mesh)
linemember_4 = LineMember(Curve=line_7, Material=isotropic_material, Section=parametric_section_2.Section, Mesh=line_mesh)
lusas_model = LUSASModel(
    Member=[linemember, linemember_3, linemember_4, linemember_2, surface_member],
    Assignments=[assignptsupp, assignptsupp_2, assignptsupp_3, assignptsupp_4],
    Stored_Units="N,mm,t,s,C")
model_preview = ModelPreview(
    Model=lusas_model,
    Stored_Analysis="Analysis 1",
    Stored_Loadcase="Loadcase 1",
    Stored_PreviewLoads=True,
    Stored_PreviewSupports=True,
    Stored_Scale=1.069614731)
link_to_lusas = LinkToLUSAS(
    Model=lusas_model,
    Stored_LastBrowsedDirectory="C:\Users\paulbd\Desktop\GRASSHOPPER\WEBINAR - FEBRUARY 2025\U-Frame Bridge",
    Stored_LastExportFilename="250210pbd_UFrameBridge.mdl",
    Stored_ModeIsModel=True)
