# Grasshopper definition 11_LUSAS_GH_ConstructionStages.gh (Grasshopper 1.0.8)
# plug-ins: LUSAS_Grasshopper

unit_x = UnitX(Factor=Slider(15, range=0..100))
unit_x_2 = UnitX(Factor=Slider(20, range=0..100))
unit_x_3 = UnitX(Factor=Slider(25, range=0..100))
unit_x_4 = UnitX(Factor=Slider(40, range=0..100))
construct_point = ConstructPoint(XCoordinate=0, YCoordinate=0, ZCoordinate=0)
move = Move(Geometry=construct_point, Motion=unit_x)  # -> Geometry, Transform
move_2 = Move(Geometry=construct_point, Motion=unit_x_2)  # -> Geometry, Transform
move_3 = Move(Geometry=construct_point, Motion=unit_x_3)  # -> Geometry, Transform
move_4 = Move(Geometry=construct_point, Motion=unit_x_4)  # -> Geometry, Transform
line = Line(StartPoint=construct_point, EndPoint=move.Geometry)
line_2 = Line(StartPoint=move.Geometry, EndPoint=move_2.Geometry)
line_3 = Line(StartPoint=move_2.Geometry, EndPoint=move_3.Geometry)
line_4 = Line(StartPoint=move_3.Geometry, EndPoint=move_4.Geometry)
line_5 = Line([line, line_2, line_3, line_4])
unit_y = UnitY(Factor=Slider(4, range=0..10))
move_5 = Move(Geometry=line_5, Motion=unit_y)  # -> Geometry, Transform
list_item = ListItem(List=move_5.Geometry, Index=0, Wrap=True)
list_item_2 = ListItem(List=move_5.Geometry, Index=1, Wrap=True)
list_item_3 = ListItem(List=move_5.Geometry, Index=2, Wrap=True)
list_item_4 = ListItem(List=move_5.Geometry, Index=3, Wrap=True)
ruled_surface = RuledSurface(CurveA=line, CurveB=list_item)
ruled_surface_2 = RuledSurface(CurveA=line_2, CurveB=list_item_2)
ruled_surface_3 = RuledSurface(CurveA=line_3, CurveB=list_item_3)
ruled_surface_4 = RuledSurface(CurveA=line_4, CurveB=list_item_4)

# ----
# Deactivate the second and last pour segments
# Activate the second pour segment
# Activate the last pour segment
# Add nonlinear controls
number_slider = Slider(0.2, range=0.1..0.5)
division = Division(A=number_slider, B=2)
number_slider_2 = Slider(1.2, range=0..10)
division_2 = Division(A=number_slider_2, B=2)
addition = Addition(A=division_2, B=division)
surface_mesh = SurfaceMesh(
    Name="QTS4",
    Size=Slider(1, range=0..1),
    Stored_MeshElementOrder="Linear",
    Stored_MeshShape="Quadrilateral",
    Stored_MeshType="ThickShell",
    Stored_Regularity=0)
surface_section = SurfaceSection(Name="Deck", Thickness=number_slider, Eccentricity=expr("-x", addition))
line_mesh = LineMesh(Name="Thick beam", Length=Slider(1, range=0..1), Stored_MeshElementOrder="Linear", Stored_MeshType="ThickBeam")
library_material = LibraryMaterial(
    Name="Concrete",
    Stored_Material_Grade="C40/50",
    Stored_Material_Region="Europe",
    Stored_Material_Standard="EN1992-2:2005",
    Stored_Material_Type="Concrete")  # -> Material, Density
library_material_2 = LibraryMaterial(
    Name="Steel",
    Stored_Material_Grade="Ungraded",
    Stored_Material_Region="Europe",
    Stored_Material_Standard="EN1993-1-1:2005",
    Stored_Material_Type="Steel - Structural")  # -> Material, Density
parametric_section = ParametricSection(
    Name="I-beams",
    B=Slider(0.4, range=0..1),
    D=number_slider_2,
    Tf=Slider(0.025, range=0..0.1),
    Tw=Slider(0.01, range=0..0.01),
    Stored_SectionSubType="Standard",
    Stored_SectionType="I")  # -> Section, Area
line_member = LineMember(
    Curve=[line_5, move_5.Geometry],
    Material=library_material_2.Material,
    Section=parametric_section.Section,
    Mesh=line_mesh)
surface_member = SurfaceMember(Brep=ruled_surface, Material=library_material.Material, Section=surface_section, Mesh=surface_mesh, Groups="P1")
panel = Panel("""LC1
LC2
LC3""")
line_6 = Line([line_5, move_5.Geometry])
gravity = Gravity(Factor=1, Loadcase=panel)
list_item_5 = ListItem(List=line_6, Index=[0, 2, -2, -4], Wrap=True)
list_item_6 = ListItem(List=line_6, Index=[3, -1], Wrap=True)
analysis = Analysis(Name="A1", Loadcases=panel, Gravity=gravity, Stored_IsBaseAnalysis=True)
panel_2 = Panel("""call selection.remove("All")
set loadcase = database.getLoadset("LC1", 0)
call loadcase.setTransientControl(0)
call loadcase.getTransientControl().setValue("CouplingReadInterval", 1.0).setValue("CouplingWriteInterval", 1.0)
call loadcase.getTransientControl().setNonlinearManual()
call loadcase.getTransientControl().setConstants().setValue("nit", 12).setValue("nalps", 2).setValue("toline", 0.75).setValue("rmaxal", 100.0E6)
call loadcase.getTransientControl().setValue("rnoral", 100.0E6).setValue("dlnorm", 0.1).setValue("rlnorm", 0.1).setValue("wlnorm", 100.0E6)
call loadcase.getTransientControl().setValue("dtnrml", 0.0).setValue("ampmx", 5.0).setValue("etmxa", 25.0).setValue("etmna", 0.0)
call loadcase.getTransientControl().setValue("alpha", 0.0).setValue("beta", 1.0).setValue("gamma", 0.5).setValue("isilcp", false)
call loadcase.getTransientControl().setValue("pnrm", 0.1).setValue("ptnrm", 0.0).setValue("tnorm", 0.0).setValue("pnorm", 0.0)
call loadcase.getTransientControl().setValue("GroundwaterSolutionType", "Auto").setValue("PermeabilityType", "Auto")
call loadcase.getTransientControl().setValue("iterStrategyType", "Auto").setValue("iterDataType", "auto")
call loadcase.getTransientControl().setOutput().setValue("IncrementIntervalForLusas", 1).setValue("IncrementIntervalForPlotFile", 1).setValue("IncrementIntervalForRestart", 0)
call loadcase.getTransientControl().setValue("MaxRestartDumpsSaved", 0).setValue("IncrementIntervalForTimeStepLog", 1).setValue("IncrementIntervalForHistory", 1)
set loadcase = nothing""")
panel_3 = Panel("""set attr = database.createDeactivate("Deact1")
call attr.setDeactivate("activeMesh", 100.0, 1.0E-6)
set attr = nothing""")
panel_4 = Panel("""set attr = database.createActivate("Act1")
call attr.processConstraintEquations(true)
set attr = nothing""")
panel_5 = Panel("""call selection.remove("All")
call selection.add("Group", "P2", "Recurse")
'selection now contains:;S39
set loadset = database.getLoadset("LC2", 0)
call view.setActiveLoadset(loadset)
set loadset = nothing
call assignment.setAllDefaults()
call assignment.setLoadset("LC2")
call database.getAttribute("Activate", "Act1").assignTo(selection, assignment)""")
panel_6 = Panel("""call selection.remove("All")
call selection.add("Group", "P3", "Recurse")
'selection now contains:;S53;S55
set loadset = database.getLoadset("LC3", 0)
call view.setActiveLoadset(loadset)
set loadset = nothing
call assignment.setAllDefaults()
call assignment.setLoadset("LC3")
call database.getAttribute("Activate", "Act1").assignTo(selection, assignment)""")
end_points = EndPoints(Curve=list_item_5)  # -> Start, End
end_points_2 = EndPoints(Curve=list_item_6)  # -> Start, End
support = Support(Name="Pin", TransSprings=Vector(0, 0, 0), RotSprings=Vector(0, 0, 0))
point = Point([end_points.Start, end_points_2.End])
assign_point_support = AssignPointSupport(Point=point, Support=support)
custom_attribute = CustomAttribute(DefineLPI=panel_4, AssignLPI=panel_6)
custom_attribute_2 = CustomAttribute(DefineLPI=panel_4, AssignLPI=panel_5)
custom_attribute_3 = CustomAttribute(DefineLPI=panel_3)
surface_member_2 = SurfaceMember(
    Brep=ruled_surface_4,
    Material=library_material.Material,
    Section=surface_section,
    Mesh=surface_mesh,
    CustomAttributes=[custom_attribute_3, custom_attribute_2],
    Groups="P2")
surface_member_3 = SurfaceMember(
    Brep=[ruled_surface_2, ruled_surface_3],
    Material=library_material.Material,
    Section=surface_section,
    Mesh=surface_mesh,
    CustomAttributes=[custom_attribute_3, custom_attribute],
    Groups="P3")
lusas_model = LUSASModel(
    Member=[line_member, surface_member, surface_member_2, surface_member_3],
    Analyses=analysis,
    Assignments=assign_point_support,
    Stored_Units="N,m,kg,s,C")
model_preview = ModelPreview(
    Model=lusas_model,
    Stored_Analysis="A1",
    Stored_Loadcase="LC1",
    Stored_PreviewLoads=True,
    Stored_PreviewSections=True,
    Stored_PreviewSupports=True,
    Stored_Scale=1)
live_link = LiveLink(
    Model=lusas_model,
    Append=panel_2,
    Run=Toggle(True),
    Stored_LastBrowsedDirectory="C:\Users\paulbd\Desktop\GRASSHOPPER\Activation",
    Stored_LastExportFilename="250505Activation.mdl",
    Stored_LinkMode=0)
